vi "LTE Host UE.gvi"   [LabVIEW Communications System Design Suite 2.0.1]
# Enqueue an element into the stop notifier if error in indicates an error. Call after each loop on host top level to synchronize host shut down in case of any error.
panel controls:
  "RIO Device": string = "RIO0"  # The RIO address of the RF hardware device
  "UE Transmitter": bool  # Enables or disables the transmitter using the current configuration.
  "UE RX Frequency [Hz]": f64 = 2000000000  # DL RX center frequency, allowed range depends on used RF device.
  "UE Manual Gain [dB]": f64  # Controls the analog RX gain in case UE AGC is switched off.
  "Transmit IP Address": string = "127.0.0.1"  # The IP address the UDP packets received from PDSCH shall be sent to.
  "UDP Transmit Port": u16 = 60001  # The UDP port the UDP packets received from PDSCH shall be sent to.
  "UE AGC": bool = TRUE  # Enables or disables the automated gain control on the receiver side. If enabled the analog RX gain of the RF device will be automatically configured within its valid range to meet a target range for the baseband receive power.
  "stop": bool
  "Reference Clock Source": string = "Internal"  # Configures the Reference Clock source used for the transceiver chain. Internal: Device internal clock REF IN / ClkIn: Clock input at the RF device (i.e. rear connector pane at USRP RIO, front connector pane for NI 579x) PXI_CLK: Backplane clock from the PXI Chassis (NI 579x only) GPS: GPS module (NI USRP RIO 295x only)
  "UE Receiver": bool  # Enables or disables the receiver using the current configuration.
  "UE RX RF Port (USRP)": enum{"RX2/RF0", "RX2/RF1"} = "RX2/RF1"  # Selects the HW RF port the DL RX will be received from (USRP RIO only).
  "symbol number for PDSCH constellation": u8 = 4  # The OFDM symbol number (counting from 0 with symbol 0 being occupied by the PDCCH) used for displaying constellation data for PDSCH IQ samples.
  "throughput select": T2 = "PDSCH (CRC ok)"  # Selects the used values for throughput calculation: PDSCH (overall): the total throughput scheduled by the eNodeB TX regardless of CRC result. PDSCH (CRC ok): the really achieved physical layer throughput, which could be decoded successfully. User data (to UDP): the higher layer throughput (from/to UDP stream) after removing the padding.
  "UE TX Frequency [Hz]": f64 = 1800000000  # UL TX center frequency, allowed range depends on used RF device.
  "UE Max RF TX Power [dBm]": f64 = 10  # Maximum RF transmit output power (upper bound - achievable for a full scale complex sine wave (CW) signal) Note: The actual time-domain RF transmit power depends on the configured resource allocation and is typically at least 15dB lower to allow for the OFDM PAPR backoff.
  "UE TX RF Port (USRP)": enum{"TX1/RF0", "TX1/RF1"} = "TX1/RF0"  # Selects the HW RF port the UL TX will be transmitted on (USRP RIO only).
  "UE TX UE Context": cluster{"RNTI": u16, "SRS Configuration": T3} = {1, TRUE, "0x200", TRUE}
    # UE-specific parameters for UL transmission.
    # RNTI: The radio network temporary identifier used for PUSCH scrambling.
    # SRS Configuration: The configuration used for transmitting sounding reference signal.
    # SRS Enabled: If TRUE, SRS location is reserved as last symbol in each UL subframe (FDD, TDD) and last 2 symbols in each special subframe (TDD) (according to 3GPP TS 36.211 §5.5.3.3: FDD: srs-SubframeConfig = 0, TDD: srs-SubframeConfig = 7).
    # SRS Subframe Allocation: Bitmap determining the subframes actually used for SRS transmission. Periodicity of 10, leftmost bit represents subframe 0.
    # Transmission Comb: Parameter transmissionComb k_TC determining if even (0) or odd (1) subcarriers are used for SRS transmission/reception. See also 3GPP TS 36.211 §5.5.3.2.
  "Timing Advance [samples]": u32  # The applied UL timing advance, i.e. the number of samples the UL TX is started earlier than the DL RX. Given in 30.72 MS/s domain.
  "UE TX Frame Structure": enum{"FDD", "TDD 5 5"} = "FDD"  # Select between FDD (frequency division duplex) and TDD (time division duplex) using subframe configuration 5 and special subframe configuration 5 (3GPP TS 36.211 §4).
  "UE RX Frame Structure": enum{"FDD", "TDD 5 5"} = "FDD"  # Select between FDD (frequency division duplex) and TDD (time division duplex) using subframe configuration 5 and special subframe configuration 5 (3GPP TS 36.211 §4).
  "UE TX Cell ID": u16  # Physical cell ID used for PUSCH scrambling.
  "UE RX Cell ID": u16  # Physical cell ID used for PSS, CRS, UERS sequence generation and PDCCH/PDSCH scrambling. [0…511].
  "UE TX DCI": T6 = {"Active"=TRUE, "MCS"="MCS 9 (QPSK, rate ~0.66)", "Resource Block Allocation (4 PRB/bit)"=33554431}  # Parameters for transmission of PUSCH. MCS: Modulation and coding scheme used for PUSCH transmission according to 3GPP TS 36.213 §7.1.7. Active: Enables or disabled the transmission of the PUSCH. Resource Block Allocation: Resource allocation for PUSCH given as bitmap with each bit representing 4 physical resource blocks (DL resource allocation type 0, 3GPP TS 36.312 §7.1.6.1). Leftmost bit represents lowest resource block index.
  "session": "LTE Host Session.gtype"
  "UE RX UE Context": T12 = {"RNTI"=1, "Use UERS"=FALSE, "Antenna Port"=7, "CCE Offset"=0}
    # UE specific parameters for DL reception.
    # Use UERS: If enabled the DL receiver will use UE specific reference signals for equalizing PDSCH assigned I/Q samples. The usage of UERS is closely related to Transmission Mode 9 defined in the LTE standard 3GPP TS 36.213 §7.1.
    # RNTI: The radio network temporary identifier used for PDSCH scrambling and PDCCH CRC mask check.
    # Antenna Port: The antenna port used for generating UERS for channel estimation, Range: 7…14 according to 3GPP TS 36.213 §7.1.
    # CCE Offset: First control channel element to be used for PDCCH reception. According to 3GPP TS 36.211 §6.8.1/.2.
  "Command": string = "ns3.26-ni-lte-wifi-extended-optimized"  # Command to execute for external MAC.
  "External MAC": bool = TRUE  # When enabled a program is executed on the RT described by command line and arguments. This switch applies for RT only. When disabled an internal basic MAX will be executed.
  "Arguments": string = "--packetSize=1000 --numPackets=1000000 --interval=500 --simTime=86400 --transmTime=20 --niApiDevMode=\"NIAPI_TS\" --niApiWifiEnabled=\"true\" --niApiLteEnabled=\"true\" --niApiEnableLogging=\"true\" --niApiEnableTapBridge=\"false\" --lwaactivate=0 --lwipactivate=0 --cientServerConfig=2 --niRemoteControlEnable=\"false\""  # Arguments to pass to the external MAC.
  "Tab": i32
  "Stop on API Confirmation Errors": bool
  "Start Extern": bool  # When enabled a program is executed on the RT described by command line and arguments. This switch applies for RT only. When disabled an internal basic MAC will be executed.
  "Show Received Confirmations with external MAC enabled": bool = TRUE
panel indicators:
  "FPGA Ready": bool  # Signals that the FPGA bitfile has been downloaded and that the device has been initialized and is ready for configuration. (Initialization can take up to 20 seconds).
  "UE RX Active": bool  # Signals that all UE RX control configurations have been applied and the receiver is running.
  "UE Coerced Gain [dB]": f64  # The actual used analog RX RF gain either set by AGC, if enabled, or by UE Manual Gain Value [dB].
  "UE ADC Values Clipped": bool  # Indicates a numeric overflow at the ADC output (i.e. analog RX RF gain too high or receive power level too high).
  "UE Baseband RX Power [dBFS]": f64  # The measured baseband receive power level in dB full scale.
  "UE RX Power Spectrum": T1  # Shows the power spectrum of the DL RX baseband signal received from RF. If synchronization is successful frequency offset compensation is applied.
  "PDSCH Constellation": c128[]  # Constellation of RX IQ samples allocated for PDSCH transmission after equalization. Only samples for the configured OFDM Symbol-Nr (PDSCH) are displayed.
  "PDCCH Constellation": c128[]  # Constellation of RX IQ samples allocated for PDCCH transmission after equalization.
  "DL throughput": f64[][]
  "UE Failure / Block Error Rate (BLER)": f64[][]  # Numerical and graphical display of error rates for synchronization detection, PDCCH and PDSCH decoding.
  "UE Frequency Offset [Hz]": f64  # The estimated and compensated frequency offset detected in the RX signal.
  "Sync Found": bool  # Indicates that the synchronization module has successfully detected and synchronized to a DL RX signal.
  "UE DDC Values Clipped": bool  # Indicates a numeric overflow at the output of the digital downconversion block (i.e. analog RX RF gain too high or input power level too high).
  "Packet Loss Out": bool  # Indicates that the system loses UDP data due to overload (i.e. data inflow from PDSCH is higher than UDP throughput).
  "channel estimation": f64[][]  # Graphical representation of the normalized channel amplitude and phase estimated on the cell specific reference signals.
  "Data Transfer Out": bool  # Indicates that the configured UDP stream is sending data to the configured Transmit IP Address using Transmit Port.
  "DL throughput (current)": f64  # Numerical and graphical indication of scheduled, successfully decodable and actually used channel capacity. PDSCH (overall): the total throughput scheduled by the eNodeB TX regardless of CRC result. PDSCH (CRC ok): the really achieved physical layer throughput, which could be decoded successfully. User data (to UDP): the higher layer throughput (from/to UDP stream) after removing the padding
  "UE Coerced Max RF TX Power [dBm]": f64  # Indicates the coerced value actually used as maximum RF transmit output power after applying the device’s capabilities (range and resolution limitations) to the configured UE Maximum RF TX Power [dBm].
  "UE TX Power Spectrum": T1  # Shows the power spectrum of the UL TX baseband signal transferred to the RF.
  "UE TX Active": bool  # Signals that all UE TX control configurations have been applied and the transmitter is running.
  "Subband SINR [dB]": f64[]  # The estimated SINR for each subband occupying 8 PRBs. Comparable to Reporting Mode 3-0 in 3GPP TS 36.213 §7.2.1. Usage of CRS or UERS for estimation depends on setting of Use UERS switch in UE RX System Parameters.
  "TX starting": bool
  "UE TX IFFT Output Clipped": bool  # Indicates a numeric overflow after the IFFT.
  "Wideband SINR [dB]": f64  # The estimated SINR over the full 20MHz band using cell specific reference signals.
  "BLER cluster": cluster{"PDSCH": f64, "PDCCH": f64, "sync": f64}
  "UE RF RX Power [dBm]": f64  # The measured time domain receive power at the RX RF port.
  "power calibration offset [dB]": f64
  "PDCCH Received DCI Message": T5[]  # Array of decoded and interpreted downlink control information messages received on PDCCH and applied to PDSCH decoding. Each element corresponds to a DL subframe.
  "Radio Frame Number": u16
  "UE RF TX Power [dBm]": f64  # Actual UE RF transmit power in dBm.
  "UE Baseband TX Power [dBFS]": f64  # Actual UE baseband transmit power level [baseband output power level] in dB full scale.
  "UE Applied Gain [dB]": f64
  "PHY Timing Indication Received": u32
  "TTI": u8
  "SFN": u16
  "L1-L2 Interface active": bool
  "MAC TX Total Delay": u32
  "DL RX Indication CRC OK": bool
  "Error Report": string
  "device bandwidth [MHz]": u16
  "External MAC Output": string
  "Received Confirmations": T13
  "Negatives": u64
  "Evaluation Errors": u32
  "MPDU Disassembly Failed": bool  # specific error cleared? indicates whether the error referenced by specific error code to clear has been cleared.
  "Status": string
  "Max Tim Ind in DMA": u32
  "Num Tim Ind Missed": u32
  "Tim Ind in DMA": u32
types:
  T1 = cluster{"f0": f64, "df": f64, "magnitude": f64[]}
  T2 = enum{"PDSCH (overall)", "PDSCH (CRC ok)", "User data (to UDP)"}
  T3 = cluster{"SRS Enabled": bool, "SRS Subframe Allocation": UFXP(10.0), "Transmission Comb": bool}
  T4 = enum{"MCS 0 (QPSK, rate ~0.12)", "MCS 1 (QPSK, rate ~0.15)", "MCS 2 (QPSK, rate ~0.19)", "MCS 3 (QPSK, rate ~0.25)", "MCS 4 (QPSK, rate ~0.30)", "MCS 5 (QPSK, rate ~0.37)", "MCS 6 (QPSK, rate ~0.44)", "MCS 7 (QPSK, rate ~0.51)", "MCS 8 (QPSK, rate ~0.59)", "MCS 9 (QPSK, rate ~0.66)", "MCS 10 (16-QAM, rate ~0.33)", "MCS 11 (16-QAM, rate ~0.37)", "MCS 12 (16-QAM, rate ~0.42)", "MCS 13 (16-QAM, rate ~0.48)", "MCS 14 (16-QAM, rate ~0.54)", "MCS 15 (16-QAM, rate ~0.60)", "MCS 16 (16-QAM, rate ~0.64)", "MCS 17 (64-QAM, rate ~0.43)", "MCS 18 (64-QAM, rate ~0.46)", "MCS 19 (64-QAM, rate ~0.50)", "MCS 20 (64-QAM, rate ~0.55)", "MCS 21 (64-QAM, rate ~0.60)", "MCS 22 (64-QAM, rate ~0.65)", "MCS 23 (64-QAM, rate ~0.70)", "MCS 24 (64-QAM, rate ~0.75)", "MCS 25 (64-QAM, rate ~0.80)", "MCS 26 (64-QAM, rate ~0.85)", "MCS 27 (64-QAM, rate ~0.89)", "MCS 28 (64-QAM, rate ~0.93)"}
  T5 = cluster{"Valid": bool, "MCS": T4, "Resource Block Allocation (4 PRB/bit)": UFXP(25.0)}
  T6 = cluster{"Active": bool, "MCS": T4, "Resource Block Allocation (4 PRB/bit)": UFXP(25.0)}
  "LTE Transport Session.gtype" = cluster{"FIFO pathname": string, "pipe reader": "Pipe Reader.gtype", "pipe writer": "Pipe Writer.gtype", "transport in RT FIFO": RTFifoRefnum<u8[]>, "transport out RT FIFO": RTFifoRefnum<u8[]>, "transport in timing source name": string, "transport in timing trigger ID": u8, "transport out timing source name": string, "transport out timing trigger ID": u8, "maximum API message size": u32}
  "niInstr Register Bus v0 Host.lvlib__Register Bus Session.gtype" = Queue<"niInstr Register Bus v0 Host.lvlib__Session Data.gtype">
  "Semaphore RefNum.gtype" = i32
  "niUsrpRio Config v1 Host.lvlib__DB Queue Reference.gtype" = Queue<"niUsrpRio Config v1 Host.lvlib__Daughterboard Data.gtype">
  "niUsrpRio Config v1 Host.lvlib__niUsrpRio Session.gtype" = cluster{"FPGA Interface": any, "RIO Interface Number": u32, "Data Clock Rate": u32, "FPGA Data Clock Rate": u32, "Global Settings Register Bus": "niInstr Register Bus v0 Host.lvlib__Register Bus Session.gtype", "Radio 0 Settings Register Bus": "niInstr Register Bus v0 Host.lvlib__Register Bus Session.gtype", "Radio 1 Settings Register Bus": "niInstr Register Bus v0 Host.lvlib__Register Bus Session.gtype", "Radio Settings Bus Semaphore": "Semaphore RefNum.gtype", "DB Queues": "niUsrpRio Config v1 Host.lvlib__DB Queue Reference.gtype"[], "Characterization Data Valid?": bool, "EEPROM Header": "niUsrpRio Config v1 Host.lvlib__EEPROM Header.gtype", "Device Data Header": "niUsrpRio Config v1 Host.lvlib__EEPROM Device Data Header.gtype", "EEPROM Characterization Header": "niUsrpRio Config v1 Host.lvlib__EEPROM Characterization Header.gtype", "Characterization Data": "niUsrpRio Config v1 Host.lvlib__Characterization Data.gtype"[], "FPGA Current Version": u32, "FPGA Oldest Compatible Version": u32, "Fixed Logic Current Version": u32, "Fixed Logic Oldest Compatible Version": u32, "FPGA Radio Settings Bus Current Version": u32, "FPGA Radio Settings Bus Oldest Compatible Version": u32, "FPGA Board Config Current Version": u32, "FPGA Board Config Oldest Compatible Version": u32, "Daughterboard Clock Rate": u32}
  T7 = cluster{"FPGA ref": any, "bus instance": u32, "instruction FIFO depth": u32, "executing on FPGA target": bool, "show error call chain": bool}
  T8 = cluster{"Actual Gain [dB]": f64, "Attenuation Table Index": i32}
  T9 = cluster{"Attenuation Table [dB]": f64[][], "Frequencies [Hz]": f64[], "IQ Imbalance Table": "niUsrpRio Config v1 Host.lvlib__IQ Imbalance.gtype"[], "Gain Table": T8[][]}
  T10 = cluster{"FlexRIO Register Bus": Queue<T7>, "RX Characterization Data": T9, "TX Characterization Data": T9, "FPGA Interface": any}
  T11 = cluster{"transport block size": u32, "CRC ok": bool, "user data": u32}
  "LTE Host Session.gtype" = cluster{"target": enum{"USRP", "FlexRIO"}, "real time mode": bool, "MAC Stub enabled": bool, "DMA FIFO read timeout": i32, "timed loop period": i64, "LTE Transport Sessions": "LTE Transport Session.gtype"[], "USRP session": "niUsrpRio Config v1 Host.lvlib__niUsrpRio Session.gtype", "FlexRIO session": T10, "UDP RX session": UdpNetworkConnectionRefnum, "UDP TX session": UdpNetworkConnectionRefnum, "sync found queue": Queue<bool>, "PDCCH CRC ok queue": Queue<bool>, "DL PDCCH status queue": Queue<cluster{"CRC ok": bool, "subframe number": u32}>, "DL PDSCH status queue": Queue<cluster{"CRC ok": bool, "subframe number": u32}>, "DL SINR queue": Queue<f64[]>, "PDSCH user data queue": Queue<u32>, "PDSCH user data UDP queue": Queue<T11>, "PDSCH user data throughput queue": Queue<T11>, "PUSCH user data queue": Queue<u32>, "PUSCH user data UDP queue": Queue<T11>, "PUSCH user data throughput queue": Queue<T11>, "UE feedback info FIFO": RTFifoRefnum<u8[]>, "Request information FIFO": RTFifoRefnum<"LTE Request Information.gtype">, "UDP TX outbound FIFO": RTFifoRefnum<u8[]>, "UDP RX inbound FIFO": RTFifoRefnum<u8[]>, "stop notifier": Notifier<string>, "DL RX scope": string, "UL RX scope": string, "external MAC log file": string, "external MAC process ID": u32}
  T12 = cluster{"RNTI": u16, "Use UERS": bool, "Antenna Port": UFXP(4.0), "CCE Offset": u8}
  "LTE Confirmation States.gtype" = enum{"Success", "Unknown Message", "Message not Supported", "Unknown Parameter (Set)", "Missing Parameter (Set)", "Parameter (Set) Repetition", "Range Violation", "State Violation", "Timeout", "Config Payload Mismatch", "Length Mismatch", "Input Buffer Full", "Internal Error", "Instance ID Mismatch"}
  T13 = cluster{"Element 1": "LTE Confirmation States.gtype"[], "Value": u64[]}
  "DTP Send Status.gtype" = cluster{"send packet counter": u32, "network too slow counter": u32}
  "DTP Pending Data.gtype" = cluster{"expected size": u32, "payload": u8[]}
diagram:
  sequence {
    frame 0 {
      # Set Controls to default values
      $"L1-L2 Interface active" <- FALSE
      $"UE Transmitter" <- FALSE
      $"UE Receiver" <- FALSE
      $"FPGA Ready" <- FALSE
      $"UE RX Active" <- FALSE
      $"UE TX Active" <- FALSE
      $"TX starting" <- FALSE
      $"Sync Found" <- FALSE
      $"PDSCH Constellation" <- c128[] []
      $"PDCCH Constellation" <- c128[] []
      Build Array(f64[] [], f64[] [], f64[] []) -> w1
      $"DL throughput" <- w1
      $"UE Failure / Block Error Rate (BLER)" <- w1
      $"channel estimation" <- w1
      $"UE RX Power Spectrum" <- T1 {all zero or empty}
      $"UE TX Power Spectrum" <- T1 {all zero or empty}
      $"UE Coerced Max RF TX Power [dBm]" <- 0
      $"UE Coerced Gain [dB]" <- 0
      $"Wideband SINR [dB]" <- 0
      $"DL throughput (current)" <- 0
      $"Subband SINR [dB]" <- f64[] []
      $"PDCCH Received DCI Message" <- T5[] []
      $"Error Report" <- ""
      $Status <- ""
    }
  }
  call "RT Startup Create Notifier.gvi"(Error In=no error) -> (Error Out=w2)
  # NI API CHANGE
  s1 = w2  # shift register
  while {
    Wait Until Next Multiple(multiple to wait=100)
    call "RT Startup Receive Notivication.gvi"(error in=s1) -> (error out=w3, notification=w4)
    $Status <- w4
    Is Equal(x=w4, y="System Init Complete!") -> w5
    next s1 = w3
    stop if w5
  }
  call "LTE UE Host Initialization.gvi"(USRP device=$"RIO Device", session in=$session, error in=w2, reference clock source=$"Reference Clock Source", start externally=$"Start Extern", external MAC=$"External MAC", command=$Command, arguments=$Arguments) -> (error out=w6, session out=w7, device bandwidth=w8)
  sequence {
    frame 0 {
      $session <- w7
      call "Display Error.gvi"(type of dialog="continue or stop message", error in=w6)
      $"L1-L2 Interface active" <- TRUE
    }
  }
  disable {
    frame TARGET_TYPE == "RT", Default {
      # Transport layer moves packets from L1 to MAC Stub implementation or external MAC
      call "LTE Transport.gvi"(session=w7, error in=w6) -> (error out=w10)
      call "LTE Get Transport Session.gvi"(Session=w7, Transport Session Select="Transport PHY Timing to MAC") -> (LTE Transport Session=w11, Session dup=w12)
      # NI API CHANGE
      call "RT Select CPU Core.gvi"(processor in=1, error in=w6) -> (processor out=w13, error out=w14)
      Property Node(instance in=w11) -> ("transport out timing source name"=w15)
      w16 = 100  # priority in
      timed loop {
        # MAC Stub: handle TX messages
        Left Execution System Border Node(priority_in=w16, processor_in=w13)
        Left Timing Source Border Node[AlarmName=L, DefaultTimingSourceName="1 MHz", DefaultTimingSourceType=2](mode_in="Process missed periods, ignore original phase", period_in=1, source_in=w15, structure_in="MAC Stub Tx")
        call "LTE Get Transport Session.gvi"(Session=w12, Transport Session Select="Transport PHY Timing to MAC") -> (LTE Transport Session=w17, Session dup=w18)
        Left Timing Error Border Node(error_in=w14) -> (error_out=w19)
        call "LTE Transport Read From Transport.gvi"(API transport session=w17, error in=w19, allow read fail=$"L1-L2 Interface active") -> (transport out=w20, transport read success=w21, error out=w22)
        case (w21) {
          frame False {
            w23 = w22
          }
          frame True {
            call "LTE PHY Receive Timing Indication.gvi"(api transport in=w20, error in=w22) -> (SFN=w24, TTI index=w25, error out=w26)
            call "LTE Check Subframe for Transmit.gvi"(frame structure=$"UE TX Frame Structure", subframe index=w25, UL TX=TRUE, error in=w26) -> (allow UL transmit=w27, error out=w28)
            case (w27) {
              frame False, Default {
                w23 = w28
              }
              frame True {
                call "LTE MAC Prepare UL Tx Config.gvi"(SFN=w24, TTI index=w25) -> (MAC TX Config=w29)
                call "LTE Receive Feedback Information.gvi"(session=w18, error in=w28) -> (feedback info=w30, error out=w31)
                Array Size(array=w30) -> (size(s)=w32)
                Is Greater Than 0(x=w32) -> w33
                case (w33) {
                  frame False, Default {
                    w23 = w31
                  }
                  frame True {
                    To Unsigned Long Integer(number=w32) -> w34
                    call "LTE PHY TX Request Confirm Abstraction.gvi"(MAC TX Config=w29, MAC PDU Size=w34, MAC PDU=w30, Device Location="UE", error in=w31) -> (api transport out=w35, error out=w36, requests=w37)
                    Property Node(instance in=w18) -> ("Request information FIFO"=w38, instance out=w39)
                    call "LTE MAC Enque Requests.gvi"(RT FIFO reference=w38, requests=w37, error in=w36) -> (error out=w40)
                    call "LTE Get Transport Session.gvi"(Session=w39, Transport Session Select="Transport MAC to PHY") -> (LTE Transport Session=w41)
                    call "LTE Transport Send To Transport.gvi"(API transport session=w41, transport in=w35, error in=w40) -> (error out=w23)
                  }
                }
              }
            }
          }
        }
        Right Timing Error Border Node(error_in=w23) -> (error_out=w42)
        Left Timing Statistics Border Node() -> (wakeupreason_out=w43)
        continue if $"L1-L2 Interface active"
      }
      call "LTE Remove Timed Loop Abort Error.gvi"(error in=w42, wake up reason=w43) -> (error out=w44)
      call "Stop On Error.gvi"(error in=w44, error source prefix="MAC Stub Tx") -> (error out=w45)
      call "LTE Get Transport Session.gvi"(Session=w7, Transport Session Select="Transport PHY to MAC") -> (LTE Transport Session=w46, Session dup=w47)
      # NI API CHANGE
      call "RT Select CPU Core.gvi"(processor in=2, error in=w6) -> (processor out=w48, error out=w49)
      Property Node(instance in=w46) -> ("transport out timing source name"=w50)
      w51 = 98  # priority in
      timed loop {
        # MAC Stub: handle RX messages
        Left Execution System Border Node(priority_in=w51, processor_in=w48)
        Left Timing Source Border Node[AlarmName=L, DefaultTimingSourceName="1 MHz", DefaultTimingSourceType=2](mode_in="Process missed periods, ignore original phase", period_in=1, source_in=w50, structure_in="MAC Stub Rx")
        call "LTE Get Transport Session.gvi"(Session=w47, Transport Session Select="Transport PHY to MAC") -> (LTE Transport Session=w52, Session dup=w53)
        Left Timing Error Border Node(error_in=w49) -> (error_out=w54)
        call "LTE Transport Read From Transport.gvi"(API transport session=w52, error in=w54, allow read fail=$"L1-L2 Interface active") -> (transport out=w55, transport read success=w56, error out=w57)
        case (w56) {
          frame False {
            w58 = w57
          }
          frame True {
            call "LTE Decode General Message Header.gvi"(message data in=w55, error in=w57) -> (decoded general message header=w59, error out=w60)
            Property Node(instance in=w59) -> ("message type ID"=w61)
            case (w61) {
              frame 0, Default {
                call "Build Error Cluster.gvi"(code=-1, description="MAC Stub Rx: unexpected API message", error in=w60) -> (error out=w58)
              }
              frame 16898 {
                # PHY_CNF
                Property Node(instance in=w53) -> ("Request information FIFO"=w62)
                Not(x=$"Stop on API Confirmation Errors") -> w63
                call "LTE Handle DL TX Confirm.gvi"(RT FIFO reference=w62, api transport in=w55, error in=w60, clear confirmation errors=w63) -> (error out=w58, confirm received counts=w64, confirmation evaluation error count=w65, negative confirm received count=w66)
                $"Received Confirmations" <- w64
                $Negatives <- w66
                $"Evaluation Errors" <- w65
              }
              frame 18433 {
                call "LTE PHY Receive RX Indication.gvi"(api transport in=w55, expected device location="UE", error in=w60) -> (MAC RX Config=w67, MAC PDU=w68, error out=w69)
                # PHY_DLSCH_RX_IND
                Property Node(instance in=w67) -> ("CRC Result"=w70)
                Is Greater Than 0(x=w70) -> w71
                case (w71) {
                  frame False, Default {
                    w58 = w69
                  }
                  frame True {
                    Property Node(instance in=w53) -> ("UDP RX inbound FIFO"=w72, instance out=w73)
                    call "LTE MAC PDU Disassembly.gvi"(MAC PDU=w68, error in=w69, FIFO in=w72) -> (bytes=w74, error out=w75)
                    call "Filter Error Code.gvi"(code to clear=-1, error in=w75) -> (error cleared?=w76, error out=w77)
                    case (w76) {
                      frame True {
                        w58 = w77
                      }
                      frame False {
                        Property Node(instance in=w73) -> ("PDSCH user data queue"=w78)
                        To Unsigned Long Integer(number=w74) -> w79
                        Scale By Power Of 2(n=3, x=w79) -> w80
                        Enqueue Element(element=w80, error in=w77, queue=w78, timeout in ms=0) -> (error out=w58)
                      }
                    }
                    $"MPDU Disassembly Failed" <- w76
                  }
                }
                $"DL RX Indication CRC OK" <- w71
              }
            }
          }
        }
        Right Timing Error Border Node(error_in=w58) -> (error_out=w81)
        Left Timing Statistics Border Node() -> (wakeupreason_out=w82)
        continue if $"L1-L2 Interface active"
      }
      call "LTE Remove Timed Loop Abort Error.gvi"(error in=w81, wake up reason=w82) -> (error out=w83)
      call "Stop On Error.gvi"(error in=w83, error source prefix="MAC Stub Rx") -> (error out=w84)
      # NI API CHANGE
      call "RT Select CPU Core.gvi"(processor in=1, error in=w6) -> (processor out=w85, error out=w86)
      w87 = 100  # priority in
      Property Node(instance in=w7) -> ("timed loop period"=w88, instance out=w89)
      timed loop {
        Left Execution System Border Node(priority_in=w87, processor_in=w85)
        # handle TTI timing indication every 1ms
        Left Timing Statistics Border Node()
        Left Timing Error Border Node(error_in=w86) -> (error_out=w90)
        call "LTE Receive Timing Indication RT.gvi"(session=w89, error in=w90, eNB TX Active=$"UE TX Active") -> (error out=w91, subframe index=w92, subframe index valid=w93, DMA max elements remaining=w94, Num Tim Ind Missed=w95, DMA elements remaining=w96)
        $"Num Tim Ind Missed" <- w95
        case (w93) {
          frame False {
            w97 = w91
            w98 = w93
            w99 = w89
          }
          frame True, Default {
            call "Get Time.gvi"(error in_2=w91) -> (tick count (us)=w100, error out_2=w101)
            call "LTE TTI Counter to SFN and TTI.gvi"(TTI counter=w92, error in=w101) -> (SFN=w102, TTI=w103, error out=w104)
            call "Counter U16 Dominant Increment.gvi"() -> (count out=w105)
            call "LTE Encode PHY SAP Timing Indication.gvi"(reference ID=w105, SFN=w102, TTI index=w103, error in=w104) -> (encoded PHY SAP Timing Indication=w106, error out=w107)
            call "LTE Get Transport Session.gvi"(Session=w89, Transport Session Select="Transport PHY Timing to MAC") -> (LTE Transport Session=w108, Session dup=w99)
            call "LTE Transport Send To Transport.gvi"(API transport session=w108, transport in=w106, error in=w107) -> (error out=w97)
            $SFN <- w102
            $TTI <- w103
            $"PHY Timing Indication Received" <- w100
            w98 = w93
          }
        }
        Logical And(w98, $"UE RX Active") -> w109
        case (w109) {
          frame False, Default {
            w110 = w97
          }
          frame True {
            call "LTE Send Dynamic DL RX Configuration.gvi"(session=w99, UE context=$"UE RX UE Context", error in=w97) -> (error out=w110)
          }
        }
        Right Timing Error Border Node(error_in=w110) -> (error_out=w111)
        Left Timing Source Border Node[AlarmName=L, DefaultTimingSourceName="1 MHz", DefaultTimingSourceType=2](mode_in="Discard missed periods, ignore original phase", period_in=w88, structure_in="PHY SAP Tim")
        $"Tim Ind in DMA" <- w96
        # NI API CHANGE
        $"Max Tim Ind in DMA" <- w94
        continue if $"L1-L2 Interface active"
      }
      call "Stop On Error.gvi"(error in=w111, error source prefix="PHY SAP Tim") -> (error out=w112)
      call "LTE Get Transport Session.gvi"(Session=w7, Transport Session Select="Transport MAC to PHY") -> (LTE Transport Session=w113, Session dup=w114)
      Property Node(instance in=w113) -> ("transport out timing source name"=w115)
      w116 = 99  # priority in
      # NI API CHANGE
      call "RT Select CPU Core.gvi"(processor in=1, error in=w6) -> (processor out=w117, error out=w118)
      timed loop {
        # handover Tx Req to FPGA
        Left Execution System Border Node(priority_in=w116, processor_in=w117)
        Left Timing Statistics Border Node()
        call "LTE Get Transport Session.gvi"(Session=w114, Transport Session Select="Transport MAC to PHY") -> (LTE Transport Session=w119, Session dup=w120)
        Left Timing Error Border Node(error_in=w118) -> (error_out=w121)
        call "LTE Transport Read From Transport.gvi"(API transport session=w119, error in=w121, allow read fail=$"L1-L2 Interface active") -> (transport out=w122, transport read success=w123, error out=w124)
        call "Get Time.gvi"(error in=w124) -> (error out=w125, tick count (us)=w126)
        Subtract(x=w126, y=$"PHY Timing Indication Received") -> w127
        # reserve time buffer to transmit TX data to FPGA
        w128 = 700  # maximal allowed TX processing time [us]
        Is Greater(x=w127, y=w128) -> w129
        case (w123) {
          frame True {
            call "LTE PHY TX Request Confirm Handler.gvi"(api transport in=w122, Expected SFN=$SFN, Expected TTI index=$TTI, Expected Device Location="UE", error in=w125, frame structure=$"UE TX Frame Structure", use UERS=FALSE, UE TX DCI=$"UE TX DCI", TX request too late=w129) -> (TX Data=w132, error out=w133, api transport out=w134, output valid=w135)
            Logical And(w135, $"UE TX Active") -> w131
            case (w131) {
              frame False, Default {
                w136 = w133
                w137 = w120
              }
              frame True {
                call "LTE Send Dynamic UL Configuration.gvi"(UE context=$"UE TX UE Context", DCI=$"UE TX DCI", scope="TX", session=w120, error in=w133) -> (error out=w138, session dup=w139)
                call "LTE Send Dynamic UL Tx Payload.gvi"(session in=w139, TX data=w132, error in=w138) -> (error out=w136, session out=w137)
              }
            }
            Property Node(instance in=w137) -> ("Request information FIFO"=w140, "MAC Stub enabled"=w141)
            Array Size(array=w134) -> (size(s)=w142)
            Is Greater Than 0(x=w142) -> w143
            Logical And(not w141, $"Show Received Confirmations with external MAC enabled") -> w144
            case (w143) {
              frame False, Default {
                call "Build Error Cluster.gvi"(code=-1, description="Confirmation message response is empty.", error in=w136) -> (error out=w130)
              }
              frame True {
                call "LTE Get Transport Session.gvi"(Session=w137, Transport Session Select="Transport PHY to MAC") -> (LTE Transport Session=w145)
                call "LTE Transport Send To Transport.gvi"(API transport session=w145, transport in=w134, error in=w136) -> (error out=w130)
                # NI API CHANGE
                case (w144) {
                  frame False { }
                  frame True {
                    call "LTE Handle DL TX Confirm.gvi"(RT FIFO reference=w140, api transport in=w134, clear confirmation errors=TRUE) -> (confirm received counts=w146, negative confirm received count=w147)
                    $"Received Confirmations" <- w146
                    $Negatives <- w147
                  }
                }
              }
            }
          }
          frame False {
            w130 = w125
            w131 = w123
          }
        }
        call "Get Time.gvi"(error in=w130) -> (error out=w148, tick count (us)=w149)
        Right Timing Error Border Node(error_in=w148) -> (error_out=w150)
        case (w131) {
          frame True {
            Subtract(x=w149, y=$"PHY Timing Indication Received") -> w151
            call "Get and Hold Maximum.gvi"(value=w151) -> (max value=w152)
            $"MAC TX Total Delay" <- w152
          }
          frame False { }
        }
        Left Timing Source Border Node[AlarmName=L, DefaultTimingSourceName="1 MHz", DefaultTimingSourceType=2](mode_in="Process missed periods, ignore original phase", period_in=1, source_in=w115, structure_in="PHY SAP Tx")
        continue if $"L1-L2 Interface active"
      }
      call "Stop On Error.gvi"(error in=w150, error source prefix="PHY SAP Tx") -> (error out=w153)
      # NI API CHANGE
      call "RT Select CPU Core.gvi"(processor in=2, error in=w6) -> (processor out=w154, error out=w155)
      Property Node(instance in=w7) -> ("timed loop period"=w156, instance out=w157)
      w158 = 98  # priority in
      timed loop {
        Left Execution System Border Node(priority_in=w158, processor_in=w154)
        Left Timing Statistics Border Node()
        Left Timing Error Border Node(error_in=w155) -> (error_out=w159)
        call "LTE Receice PDSCH Decoding Status.gvi"(session=w157, error in=w159) -> (PDSCH Decoding Status valid=w160, PDSCH Decoding Status=w161, error out=w162)
        case (w160) {
          frame False, Default {
            w163 = w162
          }
          frame True {
            Property Node(instance in=w157) -> ("DL PDSCH status queue"=w164, "PDSCH user data throughput queue"=w165, instance out=w166)
            Property Node(instance in=w166) -> ("MAC Stub enabled"=w167, instance out=w168)
            call "LTE Get Transport Session.gvi"(Session=w166, Transport Session Select="Transport PHY to MAC") -> (LTE Transport Session=w169)
            call "LTE PDSCH Channel Decoder Status from U32.gvi"(bit vector in=w161, valid in=TRUE) -> (PDSCH decoder status=w170)
            Property Node(instance in=w170) -> ("user data"=w171, "transport block size"=w172, "CRC ok"=w173)
            Enqueue Element(element=w170, error in=w162, queue=w165, timeout in ms=0) -> (error out=w174)
            Property Node(instance in=w170) -> ("CRC ok"=w175, "user data"=w176)
            w177 = cluster{"CRC ok": bool, "subframe number": u32} {all zero or empty}
            Property Node(instance in=w177, "CRC ok"=w175, "subframe number"=w176) -> (instance out=w178)
            Enqueue Element(element=w178, error in=w174, queue=w164, timeout in ms=0) -> (error out=w179)
            call "LTE Receive PDSCH MAC PDU.gvi"(session=w166, transport block size=w172, error in=w179) -> (MAC PDU=w180, error out=w181)
            Property Node(instance in=$"UE RX UE Context") -> ("RNTI"=w182)
            To Unsigned Byte Integer(number=w171) -> w183
            call "Counter U16 Dominant Increment.gvi"() -> (count out=w184)
            Boolean To Integer(Boolean=w173) -> (0, 1=w185)
            To Unsigned Byte Integer(number=w185) -> w186
            Array Size(array=w180) -> (size(s)=w187)
            To Unsigned Long Integer(number=w187) -> w188
            call "LTE Encode PHY SAP DL RX Indication.gvi"(reference ID=w184, SFN=0, TTI index=w183, MAC PDU=w180, MAC PDU Size=w188, RNTI=w182, CRC Result=w186) -> (encoded UL RX Indication=w189)
            call "LTE Transport Send To Transport.gvi"(API transport session=w169, transport in=w189, error in=w181) -> (error out=w190)
            case (w167) {
              frame False, Default {
                call "LTE Receive Feedback Information.gvi"(session=w168, error in=w190) -> (feedback info=w191, error out=w192, valid=w193)
                # external MAC
                # NI API Change
                case (w193) {
                  frame False, Default {
                    w163 = w192
                  }
                  frame True {
                    call "Counter U16 Dominant Increment.gvi"() -> (count out=w194)
                    call "LTE Interpret PUSCH Payload.gvi"(PUSCH payload=w191) -> (radioframe number=w195, subband SNR=w196, wideband SNR=w197)
                    call "LTE Encode PHY SAP Cell Measurement Indication.gvi"(reference ID=w194, SFN=w195, TTI index=0, subband SNR=w196, wideband SNR=w197, Cell ID=$"UE RX Cell ID") -> (encoded UL RX Indication=w198, message body length=w199)
                    call "LTE Transport Send To Transport.gvi"(API transport session=w169, transport in=w198, error in=w192) -> (error out=w163)
                  }
                }
              }
              frame True {
                # MAC Stub mode
                # - measurements handled completely in MAC Stub
                # - no API measage needed
                w163 = w190
              }
            }
          }
        }
        Right Timing Error Border Node(error_in=w163) -> (error_out=w200)
        Left Timing Source Border Node[AlarmName=L, DefaultTimingSourceName="1 MHz", DefaultTimingSourceType=2](mode_in="Discard missed periods, ignore original phase", period_in=w156, structure_in="PHY SAP Rx")
        continue if $"L1-L2 Interface active"
      }
      call "Stop On Error.gvi"(error in=w200, error source prefix="PHY SAP Rx") -> (error out=w201)
      s2 = w6  # shift register
      while {
        Wait(time to wait=1)
        Property Node(instance in=$session) -> ("UDP RX session"=w202, "UDP RX inbound FIFO"=w203)
        s3 = s2  # shift register
        while {
          RTFIFO Read(error in=s3, rt fifo=w203, timeout in ms=0) -> (element out=w206, empty?=w207, error out=w208)
          Array Size(array=w206) -> (size(s)=w209)
          case (w207) {
            frame True {
              w210 = w208
              w211 = default
            }
            frame False {
              Udp Write Binary(address=$"Transmit IP Address", connection ID=w202, data in=w206, error in=w208, port or service name=$"UDP Transmit Port", timeout ms=0) -> (error out=w212)
              w213 = 55  # UDP timeout
              call "Clear Errors.gvi"(specific error code to clear=w213, error in=w212) -> (specific error cleared?=w211, error out=w210)
            }
          }
          call "Is Error.gvi"(error in=w210) -> (is error?=w214)
          Logical Or(w214, w207) -> w215
          append w211 to w204
          append w209 to w205
          next s3 = w210
          stop if w215
        }
        Add Array Elements(numeric array=w205) -> (sum=w216)
        Scale By Power Of 2(n=3, x=w216) -> w217
        Is Greater Than 0(x=w217) -> w218
        $"Data Transfer Out" <- w218
        Or Array Elements(Boolean array=w204) -> (logical OR=w219)
        $"Packet Loss Out" <- w219
        call "Check Stop.gvi"(error in=s3) -> (error out=w220, stop=w221)
        next s2 = w220
        stop if w221
      }
      call "Stop On Error.gvi"(error in=s2) -> (error out=w222)
      Build Array[ConcatenateInputs=True](w45, w84, w10, w112, w153, w201, w222) -> w9
    }
    frame TARGET_TYPE != "RT" {
      s4 = w6  # shift register
      s5 = "DTP Send Status.gtype" {all zero or empty}  # shift register
      s6 = "DTP Pending Data.gtype" {all zero or empty}  # shift register
      while {
        # receive UDP data from network and send it to the FPGA as PDSCH payload data of the transmitter
        # read received PDSCH payload data from FPGA and send it to the specified UDP port
        Wait Until Next Multiple(multiple to wait=0)
        call "LTE Send UDP Data.gvi"(transmit port=$"UDP Transmit Port", transmit IP address=$"Transmit IP Address", session=$session, enable MAC RX=TRUE, error in=s4, pending data in=s6, UDP send status in=s5) -> (error out=w223, network too slow=w224, transferring data=w225, pending data out=w226, UDP send status out=w227)
        $"Data Transfer Out" <- w225
        # 5
        call "Check Stop.gvi"(error in=w223) -> (error out=w228, stop=w229)
        $"Packet Loss Out" <- w224
        next s4 = w228
        next s5 = w227
        next s6 = w226
        stop if w229
      }
      call "Stop On Error.gvi"(error in=s4) -> (error out=w230)
      s7 = w6  # shift register
      while {
        # send dynamic parameters to FPGA
        case ($"UE TX Active") {
          frame False, Default {
            Wait(time to wait=10)
            w231 = s7
            w232 = TRUE
          }
          frame True {
            call "LTE Receive Timing Indication.gvi"(session=$session, error in=s7) -> (session dup=w233, error out=w234, new timing indication=w232)
            case (w232) {
              frame False, Default {
                w231 = w234
              }
              frame True {
                call "LTE Send Dynamic UL Configuration.gvi"(UE context=$"UE TX UE Context", DCI=$"UE TX DCI", scope="TX", session=w233, error in=w234) -> (error out=w231)
              }
            }
          }
        }
        Logical And(w232, $"UE RX Active") -> w235
        case (w235) {
          frame False, Default {
            w236 = w231
          }
          frame True {
            call "LTE Send Dynamic DL RX Configuration.gvi"(session=$session, UE context=$"UE RX UE Context", error in=w231) -> (error out=w236)
          }
        }
        # 5
        call "Check Stop.gvi"(error in=w236) -> (error out=w237, stop=w238)
        next s7 = w237
        stop if w238
      }
      call "Stop On Error.gvi"(error in=s7) -> (error out=w239)
      Build Array(w230, w239) -> w9
    }
  }
  s8 = w6  # shift register
  while {
    Wait Until Next Multiple(multiple to wait=100)
    Feedback Node[DelayCount=3](input=w240) -> w241
    call "LTE Determine Configuration Trigger.gvi"(RX enabled=$"UE Receiver", TX enabled=$"UE Transmitter") -> (trigger RX configuration=w242, trigger TX configuration=w243)
    # configure UE RX/TX baseband and RF when enabled
    # 1
    case (w242) {
      frame False, Default {
        w244 = s8
      }
      frame True {
        case ($"UE Receiver") {
          frame False, Default {
            call "LTE Disable DL RX.gvi"(session=$session, error in=s8) -> (error out=w244)
            sequence {
              frame 0 {
                $"UE RX Active" <- FALSE
              }
            }
          }
          frame True {
            Property Node(instance in=$session) -> ("real time mode"=w245)
            call "LTE Setup DL RX Baseband.gvi"(frame structure=$"UE RX Frame Structure", session in=$session, error in=s8, cell ID=$"UE RX Cell ID", UE context=$"UE RX UE Context", real time mode=w245) -> (error out=w246, session dup=w247)
            call "LTE Setup RX.gvi"(session in=w247, RX port=$"UE RX RF Port (USRP)", error in=w246, RX frequency [Hz]=$"UE RX Frequency [Hz]", gain value [dB]=$"UE Coerced Gain [dB]", LTE scope="DL") -> (session out=w248, coerced gain [dB]=w249, error out=w250, coerced frequency [Hz]=w251)
            $session <- w248
            $"UE Coerced Gain [dB]" <- w249
            $"UE RX Frequency [Hz]" <- w251
            case (w250) {
              frame Error {
                $"UE Receiver" <- FALSE
                w244 = w250
              }
              frame No Error {
                $"UE RX Active" <- TRUE
                disable {
                  frame TARGET_TYPE == "RT", Default {
                    # For RT, TX triggers RX configuration
                    $"UE Transmitter" <- TRUE
                  }
                  frame TARGET_TYPE != "RT" { }
                }
                w244 = w250
              }
            }
          }
        }
      }
    }
    case (w243) {
      frame False, Default {
        w252 = s8
      }
      frame True {
        case ($"UE Transmitter") {
          frame False, Default {
            sequence {
              frame 0 {
                $"UE TX Active" <- FALSE
              }
              frame 1 {
                Wait(time to wait=10)
              }
            }
            call "LTE Disable UL TX.gvi"(session=$session, error in=s8) -> (error out=w253)
            disable {
              frame TARGET_TYPE == "RT", Default {
                # For RT, disable also RX configuration
                $"UE Receiver" <- FALSE
                w252 = w253
              }
              frame TARGET_TYPE != "RT" {
                w252 = w253
              }
            }
          }
          frame True {
            case (s8) {
              frame Error {
                w254 = s8
              }
              frame No Error {
                $"TX starting" <- TRUE
                w254 = s8
              }
            }
            Property Node(instance in=$session) -> ("real time mode"=w255)
            call "LTE Setup UL TX Baseband.gvi"(UL frequency [Hz]=$"UE TX Frequency [Hz]", session in=$session, frame structure=$"UE TX Frame Structure", cell ID=$"UE TX Cell ID", DCI=$"UE TX DCI", error in=w254, DL frequency [Hz]=$"UE RX Frequency [Hz]", UE Context=$"UE TX UE Context", real time mode=w255) -> (session dup=w256, error out=w257)
            call "LTE Setup TX.gvi"(session in=w256, TX frequency [Hz]=$"UE TX Frequency [Hz]", TX power level [dB]=$"UE Max RF TX Power [dBm]", TX port=$"UE TX RF Port (USRP)", error in=w257, LTE scope="UL", timing advance=$"Timing Advance [samples]") -> (coerced output power [dB]=w258, error out=w259, session dup=w260, coerced frequency [Hz]=w261, coerced power level setting [dB]=w262)
            $"UE Coerced Max RF TX Power [dBm]" <- w258
            case (w259) {
              frame No Error, Default {
                $"UE TX Active" <- TRUE
                $"TX starting" <- FALSE
                call "LTE Setup UL TX Set Active.gvi"(session in=w260, error in=w259) -> (error out=w252)
              }
              frame Error {
                $"UE Transmitter" <- FALSE
                $"TX starting" <- FALSE
                w252 = w259
              }
            }
            $"UE TX Frequency [Hz]" <- w261
            $"UE Max RF TX Power [dBm]" <- w262
          }
        }
      }
    }
    Merge Errors(w244, w252) -> (error out=w263)
    # synchronize the exit condition across all loops of the host application
    call "Create Stop.gvi"(error in=w263, stop in=$stop) -> (error out=w264)
    call "Check Stop.gvi"(error in=w264) -> (error out=w265, stop=w240)
    Not(x=w240) -> w266
    # Disable TX and RX to
    # ensure proper shutdown
    $"L1-L2 Interface active" <- w266
    case (s8) {
      frame Error { }
      frame No Error {
        $"FPGA Ready" <- TRUE
      }
    }
    case (w240) {
      frame False, Default { }
      frame True {
        $"UE Receiver" <- FALSE
        $"UE Transmitter" <- FALSE
      }
    }
    next s8 = w265
    stop if w241
  }
  call "Stop On Error.gvi"(error in=s8) -> (error out=w267)
  s9 = w6  # shift register
  while (iteration -> i1) {
    Wait Until Next Multiple(multiple to wait=50)
    disable {
      frame TARGET_TYPE == "RT", Default {
        w268 = $session
        w269 = s9
      }
      frame TARGET_TYPE != "RT" {
        call "LTE Read PDSCH Decoder Status.gvi"(session in=$session, error in=s9) -> (error out=w269, session dup=w268)
      }
    }
    call "LTE Get ADC and IFFT Status.gvi"(session in=w268, error in=w269) -> (ADC values clipped=w270, error out=w271, TX IFFT output clipped=w272, RX DDC values clipped=w273, session dup=w274)
    call "LTE Read DL BB Power and sync status.gvi"(error in=w271, session in=w274) -> (session dup=w275, error out=w276, RX baseband input power=w277, DL frequency offset [Hz]=w278, signal detected?=w279)
    call "LTE Read TX BB Power.gvi"(error in=w276, session in=w275, TX reference level [dBm]=$"UE Coerced Max RF TX Power [dBm]", LTE scope="UL") -> (session dup=w280, error out=w281, TX power [dBm]=w282, TX baseband power [dBFS]=w283)
    call "LTE Calculate Power Calibration Offset.gvi"(session in=w280, frequency [Hz]=$"UE RX Frequency [Hz]", error in=w281, LTE scope="DL") -> (session dup=w284, power calibration offset [dB]=w285, error out=w286)
    $"power calibration offset [dB]" <- w285
    Not(x=$"UE AGC") -> w287
    call "LTE Control Power Gain.gvi"(expected signal range lower bound=-17, use manual gain=w287, BB input power=w277, gain in=$"UE Coerced Gain [dB]", manual gain value [dB]=$"UE Manual Gain [dB]", expected signal range upper bound=-15, power calibration offset [dB]=w285) -> (RF input power [dBm]=w288, power [dBFS]=w289, gain out=w290)
    # read sync status and baseband power levels from FPGA and feed them into automatic gain control (AGC)
    # use manual gain value if AGC is disabled
    # configure frequency offset on FPGA
    # read PDSCH decoder status
    Logical And($"UE Receiver", $"UE RX Active", not $"TX starting") -> w291
    # 2
    case (w291) {
      frame False, Default {
        w292 = w286
      }
      frame True {
        call "LTE Apply AGC Output.gvi"(session=w284, LTE scope="DL", error in=w286, apply values=w291, AGC output=w290) -> (coerced gain [dB]=w293, error out=w292)
        $"UE Coerced Gain [dB]" <- w293
      }
    }
    call "Check Stop.gvi"(error in=w292) -> (error out=w294, stop=w295)
    $"UE RF TX Power [dBm]" <- w282
    $"UE Baseband TX Power [dBFS]" <- w283
    $"UE Baseband RX Power [dBFS]" <- w289
    $"UE RF RX Power [dBm]" <- w288
    $"UE Frequency Offset [Hz]" <- w278
    $"Sync Found" <- w279
    $"UE ADC Values Clipped" <- w270
    $"UE TX IFFT Output Clipped" <- w272
    To Unsigned Long Integer(number=i1) -> w296
    Quotient And Remainder(x=w296, y=10) -> (x-y*floor(x/y)=w297)
    Is Equal To 0(x=w297) -> w298
    Logical Or(w273, w298) -> w299
    Feedback Node(enable?=w299, input=w273) -> w300
    Feedback Node(enable?=w298, input=w300) -> w301
    $"UE DDC Values Clipped" <- w301
    next s9 = w294
    stop if w295
  }
  call "Stop On Error.gvi"(error in=s9) -> (error out=w302)
  s10 = w6  # shift register
  while (iteration -> i2) {
    Wait Until Next Multiple(multiple to wait=20)
    Quotient And Remainder(x=i2, y=5) -> (x-y*floor(x/y)=w303)
    # read RX/TX baseband data values and PDCCH/PDSCH constellation data from FPGA and draw corresponding diagrams
    # 3
    case (w303) {
      frame 0, Default {
        # NI API CHANGE
        case ($"External MAC") {
          frame True {
            w304 = s10
          }
          frame False {
            call "LTE Read TX Data.gvi"(session=$session, error in=s10) -> (error out=w305, TX baseband data=w306)
            call "LTE Calculate TX Power Spectrum.gvi"(TX data=w306, error in=w305, coerced gain [dB]=$"UE Coerced Max RF TX Power [dBm]") -> (TX power spectrum=w307, error out=w304)
            $"UE TX Power Spectrum" <- w307
          }
        }
      }
      frame 1 {
        # NI API CHANGE
        case ($"External MAC") {
          frame True {
            w304 = s10
          }
          frame False {
            call "LTE Read RX Data.gvi"(session=$session, error in=s10) -> (RX data=w308, error out=w309)
            call "LTE Calculate RX Power Spectrum.gvi"(RX data=w308, coerced gain [dB]=$"UE Coerced Gain [dB]", error in=w309, power calibration offset [dB]=$"power calibration offset [dB]") -> (RX power spectrum=w310, error out=w304)
            $"UE RX Power Spectrum" <- w310
          }
        }
      }
      frame 2 {
        case ($"External MAC") {
          frame False, Default {
            w311 = s10
          }
          frame True {
            call "LTE Read External MAC Output.gvi"(session=$session, error in=s10, full log=FALSE) -> (external MAC log output=w312, error out=w311)
            $"External MAC Output" <- w312
          }
        }
        case (TRUE) {
          frame False, Default {
            w313 = s10
          }
          frame True {
            call "LTE Read PDCCH Data.gvi"(session in=$session, error in=s10) -> (DCI messages=w314, error out=w313)
            $"PDCCH Received DCI Message" <- w314
          }
        }
        Merge Errors(w311, w313) -> (error out=w304)
      }
      frame 3 {
        # NI API CHANGE
        case ($"External MAC") {
          frame True {
            w304 = s10
          }
          frame False {
            call "LTE Read Constellation Data.gvi"(session=$session, error in=s10, symbol number for display=$"symbol number for PDSCH constellation", RX tab=$Tab) -> (constellation data=w315, display data out=w316, error out=w304, displayed constellation=w317)
            case (w316) {
              frame False, Default { }
              frame True {
                case (w317) {
                  frame "DL EQ Output", Default {
                    $"PDCCH Constellation" <- w315
                  }
                  frame "PDSCH Dec Input" {
                    $"PDSCH Constellation" <- w315
                  }
                }
              }
            }
          }
        }
      }
      frame 4 {
        call "LTE Read Channel Estimates.gvi"(session=$session, error in=s10, UE Context=$"UE RX UE Context") -> (channel estimation=w318, error out=w304, subband SNR [dB]=w319, wideband SNR [dB]=w320)
        $"channel estimation" <- w318
        $"Subband SINR [dB]" <- w319
        $"Wideband SINR [dB]" <- w320
      }
    }
    call "Check Stop.gvi"(error in=w304) -> (error out=w321, stop=w322)
    next s10 = w321
    stop if w322
  }
  sequence {
    frame 0 {
      call "LTE Read External MAC Output.gvi"(session=$session, error in=s10, full log=TRUE) -> (external MAC log output=w323, error out=w324)
      $"External MAC Output" <- w323
    }
  }
  call "Stop On Error.gvi"(error in=w324) -> (error out=w325)
  s11 = 0  # shift register
  s12 = w6  # shift register
  s13 = f64[] []  # shift register
  while {
    Wait Until Next Multiple(multiple to wait=1000)
    # compute throughput and block error rate and draw corresponding diagrams
    Tick Count() -> (timer value=w326)
    Subtract(x=w326, y=s11) -> w327
    call "LTE Calculate DL Throughput and BLER.gvi"(time difference=w327, session=$session, error in=s12, DL throughput previous=s13, throughput select=$"throughput select") -> (DL throughput (current)=w328, DL throughput averaged=w329, DL BLER=w330, BLER cluster=w331, error out=w332, DL throughput current=w333)
    # 4
    case ($"UE RX Active") {
      frame False, Default { }
      frame True {
        $"DL throughput (current)" <- w328
        $"DL throughput" <- w329
        $"UE Failure / Block Error Rate (BLER)" <- w330
      }
    }
    call "Check Stop.gvi"(error in=w332) -> (error out=w334, stop=w335)
    $"BLER cluster" <- w331
    next s11 = w326
    next s12 = w334
    next s13 = w333
    stop if w335
  }
  call "Stop On Error.gvi"(error in=s12) -> (error out=w336)
  s14 = w6  # shift register
  while (iteration -> i3) {
    Quotient And Remainder(x=i3, y=1024) -> (x-y*floor(x/y)=w337)
    To Unsigned Word Integer(number=w337) -> w338
    $"Radio Frame Number" <- w338
    Wait Until Next Multiple(multiple to wait=0)
    # compute feedback information and send it to the FPGA as PUSCH payload data of the transmitter
    call "LTE Compute Feedback Information.gvi"(radioframe number=w338, session=$session, error in=s14) -> (error out=w339, feedback info=w340, session dup=w341)
    call "LTE Send Feedback Information.gvi"(feedback info=w340, session=w341, error in=w339, UL TX active=$"UE TX Active") -> (error out=w342)
    call "Check Stop.gvi"(error in=w342) -> (error out=w343, stop=w344)
    next s14 = w343
    stop if w344
  }
  call "Stop On Error.gvi"(error in=s14) -> (error out=w345)
  Build Array[ConcatenateInputs=True](w267, w302, w325, w336, w345, w9) -> w346
  sequence (after w346) {
    frame 0 {
      # NI API CHANGE
      call "RT Startup Send Notification.gvi"(Error In=s1, Notification="System Stopped!") -> (Error Out=w347)
      call "RT Startup Destroy Notifier.gvi"(error in=w347)
    }
  }
  # NI API CHANGE
  call "LTE Read External MAC Output.gvi"(session=w7, full log=TRUE) -> (external MAC log output=w348)
  $"External MAC Output" <- w348
  sequence {
    frame 0 {
      call "LTE UE Host Cleanup.gvi"(session=$session, error in=no error) -> (error out=w349)
      Build Array[ConcatenateInputs=True](w346, w349) -> w350
      $"FPGA Ready" <- FALSE
    }
  }
  call "LTE Generate Error Report.gvi"(error in=w350) -> (error report=w351, error occured=w352)
  $"Error Report" <- w351
  case (w352) {
    frame False, Default { }
    frame True {
      # Switch to status tab
      # in case of error
      $Tab <- 2
    }
  }
  $"device bandwidth [MHz]" <- w8
