vi "LTE Host eNodeB.gvi"   [LabVIEW Communications System Design Suite 2.0.1]
panel controls:
  "RIO Device": string = "RIO0"  # The RIO address of the RF hardware device
  "eNB TX Frequency [Hz]": f64 = 2000000000  # DL TX center frequency, allowed range depends on used RF device
  "eNB Max RF TX Power [dBm]": f64 = 10  # Maximum RF transmit output power (upper bound - achievable for a full scale complex sine wave (CW) signal) Note: The actual time-domain RF transmit power depends on the configured resource allocation and is typically at least 15dB lower to allow for the OFDM PAPR backoff.
  "UDP Receive Port": u16 = 50001  # The UDP port the host monitors for incoming packets to be transferred to the FPGA PDSCH chain.
  "Reference Clock Source": string = "Internal"  # Configures the Reference Clock source used for the transceiver chain. Internal: Device internal clock REF IN / ClkIn: Clock input at the RF device (i.e. rear connector pane at USRP RIO, front connector pane for NI 579x) PXI_CLK: Backplane clock from the PXI Chassis (NI 579x only) GPS: GPS module (NI USRP RIO 295x only)
  "stop": bool
  "eNB TX RF Port (USRP)": enum{"TX1/RF0", "TX1/RF1"} = "TX1/RF0"  # Selects the HW RF port where the DL TX is transmitted (USRP RIO only).
  "eNB RX Frequency [Hz]": f64 = 1800000000  # UL RX center frequency, allowed range depends on used RF device
  "symbol number for PUSCH constellation": u8 = 4  # The OFDM symbol number used for displaying constellation data for PUSCH IQ samples.
  "eNB RX RF Port (USRP)": enum{"RX2/RF0", "RX2/RF1"} = "RX2/RF1"  # Selects the HW RF port the UL RX will be received from (USRP RIO only)
  "eNB Transmitter": bool  # Enables or disables the transmitter using the current configuration.
  "eNB Receiver": bool  # Enables or disables the receiver using the current configuration.
  "eNB Manual Gain [dB]": f64  # Controls the analog RX gain in case eNB AGC is switched off.
  "eNB AGC": bool = TRUE  # Enables or disables the automated gain control on the receiver side. If enabled the analog RX gain of the RF device will be automatically configured within its valid range to meet a target range for the baseband receive power.
  "Rate Adaption": bool  # If enabled, eNB TX MCS is automatically adapted to reported/measured Wideband SINR [dB] to handle with channel quality fluctuations. The adaptation is calibrated so that the applied MCS produces about 5% to 10% BLER under current MCS conditions. If that is not desired, SINR Offset [dB] needs to be modified.
  "SINR Offset [dB]": f64 = 3  # This value is effectively subtracted from the reported SINR before looking up the MCS in the adaptation table (i.e. if a positive offset is configured, a higher reported SINR is required to adapt to a certain MCS to avoid block errors).
  "eNB TX UE Context": T2 = {"RNTI"=1, "Use UERS"=FALSE, "Antenna Port"=7, "CCE Offset"=0}
    # UE specific parameters for DL transmission.
    # USE UERS: If enabled, the DL transmitter feeds UE-specific reference signals into the PDSCH data stream. The usage of UERS is closely related to Transmission Mode 9 defined in the LTE standard 3GPP TS 36.213 §7.1.
    # RNTI: The radio network temporary identifier used for PDSCH scrambling and PDCCH CRC mask generation.
    # Antenna Port: The antenna port used for generating UERS, Range: 7…14 according to 3GPP TS 36.213 §7.1.
    # CCE Offset: First control channel element to be used for PDCCH transmission. According to 3GPP TS 36.211 §6.8.1/.2.
  "eNB RX UE Context": cluster{"RNTI": u16, "SRS Configuration": T3} = {1, TRUE, "0x200", TRUE}
    # UE-specific parameters for UL reception.
    # RNTI: The radio network temporary identifier used for PUSCH scrambling.
    # SRS Configuration: The configuration used for receiving sounding reference signals.
    # SRS Enabled: If TRUE, SRS location is reserved as last symbol in each UL subframe (FDD, TDD) and last 2 symbols in each special subframe (TDD) (according to 3GPP TS 36.211 §5.5.3.3: FDD: srs-SubframeConfig = 0, TDD: srs-SubframeConfig = 7).
    # SRS Subframe Allocation: Bitmap determining the subframes actually used for SRS transmission. Periodicity of 10, leftmost bit represents subframe 0.
    # Transmission Comb: Parameter transmissionComb k_TC determining if even (0) or odd (1) subcarriers are used for SRS transmission/reception. See also 3GPP TS 36.211 §5.5.3.2.
  "eNB TX Frame Structure": enum{"FDD", "TDD 5 5"} = "FDD"  # Select between frequency division duplex (FDD) and time division duplex (TDD) using subframe configuration 5 and special subframe configuration 5 (3GPP TS 36.211 §4)
  "eNB RX Frame Structure": enum{"FDD", "TDD 5 5"} = "FDD"  # Select between FDD (frequency division duplex) and TDD (time division duplex) using subframe configuration 5 and special subframe configuration 5 (3GPP TS 36.211 §4).
  "eNB RX Cell ID": u16  # The physical Cell ID used for PUSCH scrambling
  "eNB TX Cell ID": u16  # Physical cell ID used for PSS, CRS, UERS sequence generation and PDCCH/PDSCH scrambling. [0…511].
  "eNB TX DCI": T5 = {"Active"=TRUE, "MCS"="MCS 17 (64-QAM, rate ~0.43)", "Resource Block Allocation (4 PRB/bit)"=8388607}  # Downlink control information for the PDCCH content and the PDSCH transmission. MCS: Modulation and coding scheme used for PDSCH transmission according to 3GPP TS 36.213 §7.1.7 Active: Enables or Disables the transmission of PDCCH and PDSCH. Resource Block Allocation: Resource allocation given as bitmap with each bit representing four physical resource blocks (DL resource allocation type 0, 3GPP TS 36.213 §7.1.6.1). The left-most bit represents lowest resource block index.
  "eNB RX DCI": T5 = {"Active"=TRUE, "MCS"="MCS 9 (QPSK, rate ~0.66)", "Resource Block Allocation (4 PRB/bit)"=33554431}  # Parameters for reception of PUSCH. MCS: Modulation and coding scheme used for PUSCH reception according to 3GPP TS 36.213 §7.1.7. Active: Enables or disabled the reception of the PUSCH. Resource Block Allocation: Resource allocation for PUSCH given as bitmap with each bit representing 4 physical resource blocks (DL resource allocation type 0, 3GPP TS 36.312 §7.1.6.1). Leftmost bit represents lowest resource block index.
  "eNB Timing Offset": i32  # Changes the eNodeB timing (start of radio frame). Given in 30.72MS/s.
  "session": "LTE Host Session.gtype"
  "Command": string = "ns3.26-ni-lte-wifi-extended-optimized"  # Command to execute for external MAC
  "External MAC": bool = TRUE  # When enabled a program is executed on the RT described by command line and arguments. This switch applies for RT only. When disabled an internal basic MAC will be executed.
  "Arguments": string = "--packetSize=1000 --numPackets=1000000 --interval=500 --simTime=86400 --transmTime=20 --niApiDevMode=\"NIAPI_BS\" --niApiWifiEnabled=\"true\" --niApiLteEnabled=\"true\" --niApiEnableLogging=\"true\" --niApiEnableTapBridge=\"false\" --lwaactivate=0 --lwipactivate=0 --cientServerConfig=2 --niRemoteControlEnable=\"false\""  # Arguments to pass to the external MAC.
  "Stop on API Confirmation Errors": bool
  "Start Extern": bool  # When enabled a program is executed on the RT described by command line and arguments. This switch applies for RT only. When disabled an internal basic MAC will be executed.
  "Show Received Confirmations with external MAC enabled": bool = TRUE
panel indicators:
  "FPGA Ready": bool  # Signals that the FPGA bitfile has been downloaded and that the device has been initialized and is ready for configuration. (Initialization can take up to 20 seconds.).
  "eNB TX Active": bool  # Signals that all eNB TX control configurations have been applied and the transmitter is running.
  "eNB Coerced Max RF TX Power [dBm]": f64  # Indicates the coerced value actually used as maximum RF transmit output power level after applying the device’s capabilities (range and resolution limitations) to the configured eNB Maximum RF TX Power [dBm].
  "Data Transfer In": bool  # Indicates that the configured UDP stream is receiving data on the configured Receive Port.
  "Packet Loss In": bool  # Indicates that the system loses UDP data due to overload. Data inflow from UDP port is higher than configured PDSCH throughput.
  "eNB TX Power Spectrum": T1  # Shows the power spectrum of the DL TX baseband signal transferred to the RF.
  "eNB Coerced Gain [dB]": f64  # The actual used analog RX RF gain either set by AGC, if enabled, or by UE Manual Gain Value [dB]
  "eNB ADC Values Clipped": bool  # Indicates a numeric overflow at the ADC output. Overflows can be caused when the analog RX RF gain too high or the receive power level too high.
  "eNB Baseband RX Power [dBFS]": f64
  "eNB DDC Values Clipped": bool  # Indicates a numeric overflow at the output of the digital downconversion block Overflows can be caused when the analog RX RF gain too high or the receive power level too high.
  "eNB RX Power Spectrum": T1  # Shows the power spectrum of the UL RX baseband signal received from RF.
  "PUSCH Constellation": c128[]  # Constellation of RX IQ samples allocated for PUSCH transmission after equalization. Only samples for the configured OFDM Symbol-Nr (PUSCH) are displayed.
  "eNB Failure / Block Error Rate (BLER)": f64  # Graphical display of PUSCH reception block error rate.
  "eNB RX Active": bool  # Signals that all eNB RX control configurations have been applied and the receiver is running.
  "PUSCH Throughput [Mbps]": f64  # The achieved throughput on the PUSCH channel.
  "Radio Frame Number": u16  # The number of the latest successfully received report ranging from 0…1023.
  "Reported DL ACK/NACK": enum{"NACK", "ACK", "DTX"}[]  # Array showing the latest received DL ACK/NACK report from UE side.
  "Average DL error rate": f64
  "Reported DL Block Error Rate": f64  # Graphical and numerical representation of the DL receiver block error rate on the UE side reported back to the eNodeB.
  "TX starting": bool
  "eNB TX IFFT Output Clipped": bool  # Indicates a numeric overflow after the IFFT.
  "eNB RF RX Power [dBm]": f64
  "power calibration offset [dB]": f64
  "Reported Subband SINR [dB]": f64[]  # The reported SINR for each subband occupying 8 PRBs. Comparable to Reporting Mode 3-0 in 3GPP TS 36.213 §7.2.1. Usage of CRS or UERS for estimation depends on setting of Use UERS switch in UE RX System Parameters on the UE side
  "Reported WB SINR": f64  # The reported SINR over the full 20MHz band using cell specific reference signals.
  "eNB RF TX Power [dBm]": f64  # Actual eNB RF transmit power in dBm.
  "eNB Baseband TX Power [dBFS]": f64  # Actual eNB baseband transmit power level [baseband output power level] in dB full scale.
  "PUSCH BLER (current)": f64
  "eNB Applied Gain [dB]": f64
  "L1-L2 Interface active": bool
  "PHY Timing Indication Received": u32
  "TTI": u8
  "SFN": u16
  "Max MAC TX Delay": u32
  "Error Report": string
  "UL RX Indication CRC OK": bool
  "Evaluation Errors": u32
  "Negatives": u64
  "Tab": i32
  "device bandwidth [MHz]": u16
  "External MAC Output": string
  "IP Packets Size Exeeded Count": u32
  "Received Confirmations": T11
  "Status": string
  "Max Tim Ind in DMA": u32
  "Num Tim Ind Missed": u32
  "Tim Ind in DMA": u32
types:
  T1 = cluster{"f0": f64, "df": f64, "magnitude": f64[]}
  T2 = cluster{"RNTI": u16, "Use UERS": bool, "Antenna Port": UFXP(4.0), "CCE Offset": u8}
  T3 = cluster{"SRS Enabled": bool, "SRS Subframe Allocation": UFXP(10.0), "Transmission Comb": bool}
  T4 = enum{"MCS 0 (QPSK, rate ~0.12)", "MCS 1 (QPSK, rate ~0.15)", "MCS 2 (QPSK, rate ~0.19)", "MCS 3 (QPSK, rate ~0.25)", "MCS 4 (QPSK, rate ~0.30)", "MCS 5 (QPSK, rate ~0.37)", "MCS 6 (QPSK, rate ~0.44)", "MCS 7 (QPSK, rate ~0.51)", "MCS 8 (QPSK, rate ~0.59)", "MCS 9 (QPSK, rate ~0.66)", "MCS 10 (16-QAM, rate ~0.33)", "MCS 11 (16-QAM, rate ~0.37)", "MCS 12 (16-QAM, rate ~0.42)", "MCS 13 (16-QAM, rate ~0.48)", "MCS 14 (16-QAM, rate ~0.54)", "MCS 15 (16-QAM, rate ~0.60)", "MCS 16 (16-QAM, rate ~0.64)", "MCS 17 (64-QAM, rate ~0.43)", "MCS 18 (64-QAM, rate ~0.46)", "MCS 19 (64-QAM, rate ~0.50)", "MCS 20 (64-QAM, rate ~0.55)", "MCS 21 (64-QAM, rate ~0.60)", "MCS 22 (64-QAM, rate ~0.65)", "MCS 23 (64-QAM, rate ~0.70)", "MCS 24 (64-QAM, rate ~0.75)", "MCS 25 (64-QAM, rate ~0.80)", "MCS 26 (64-QAM, rate ~0.85)", "MCS 27 (64-QAM, rate ~0.89)", "MCS 28 (64-QAM, rate ~0.93)"}
  T5 = cluster{"Active": bool, "MCS": T4, "Resource Block Allocation (4 PRB/bit)": UFXP(25.0)}
  "LTE Transport Session.gtype" = cluster{"FIFO pathname": string, "pipe reader": "Pipe Reader.gtype", "pipe writer": "Pipe Writer.gtype", "transport in RT FIFO": RTFifoRefnum<u8[]>, "transport out RT FIFO": RTFifoRefnum<u8[]>, "transport in timing source name": string, "transport in timing trigger ID": u8, "transport out timing source name": string, "transport out timing trigger ID": u8, "maximum API message size": u32}
  "niInstr Register Bus v0 Host.lvlib__Register Bus Session.gtype" = Queue<"niInstr Register Bus v0 Host.lvlib__Session Data.gtype">
  "Semaphore RefNum.gtype" = i32
  "niUsrpRio Config v1 Host.lvlib__DB Queue Reference.gtype" = Queue<"niUsrpRio Config v1 Host.lvlib__Daughterboard Data.gtype">
  "niUsrpRio Config v1 Host.lvlib__niUsrpRio Session.gtype" = cluster{"FPGA Interface": any, "RIO Interface Number": u32, "Data Clock Rate": u32, "FPGA Data Clock Rate": u32, "Global Settings Register Bus": "niInstr Register Bus v0 Host.lvlib__Register Bus Session.gtype", "Radio 0 Settings Register Bus": "niInstr Register Bus v0 Host.lvlib__Register Bus Session.gtype", "Radio 1 Settings Register Bus": "niInstr Register Bus v0 Host.lvlib__Register Bus Session.gtype", "Radio Settings Bus Semaphore": "Semaphore RefNum.gtype", "DB Queues": "niUsrpRio Config v1 Host.lvlib__DB Queue Reference.gtype"[], "Characterization Data Valid?": bool, "EEPROM Header": "niUsrpRio Config v1 Host.lvlib__EEPROM Header.gtype", "Device Data Header": "niUsrpRio Config v1 Host.lvlib__EEPROM Device Data Header.gtype", "EEPROM Characterization Header": "niUsrpRio Config v1 Host.lvlib__EEPROM Characterization Header.gtype", "Characterization Data": "niUsrpRio Config v1 Host.lvlib__Characterization Data.gtype"[], "FPGA Current Version": u32, "FPGA Oldest Compatible Version": u32, "Fixed Logic Current Version": u32, "Fixed Logic Oldest Compatible Version": u32, "FPGA Radio Settings Bus Current Version": u32, "FPGA Radio Settings Bus Oldest Compatible Version": u32, "FPGA Board Config Current Version": u32, "FPGA Board Config Oldest Compatible Version": u32, "Daughterboard Clock Rate": u32}
  T6 = cluster{"FPGA ref": any, "bus instance": u32, "instruction FIFO depth": u32, "executing on FPGA target": bool, "show error call chain": bool}
  T7 = cluster{"Actual Gain [dB]": f64, "Attenuation Table Index": i32}
  T8 = cluster{"Attenuation Table [dB]": f64[][], "Frequencies [Hz]": f64[], "IQ Imbalance Table": "niUsrpRio Config v1 Host.lvlib__IQ Imbalance.gtype"[], "Gain Table": T7[][]}
  T9 = cluster{"FlexRIO Register Bus": Queue<T6>, "RX Characterization Data": T8, "TX Characterization Data": T8, "FPGA Interface": any}
  T10 = cluster{"transport block size": u32, "CRC ok": bool, "user data": u32}
  "LTE Host Session.gtype" = cluster{"target": enum{"USRP", "FlexRIO"}, "real time mode": bool, "MAC Stub enabled": bool, "DMA FIFO read timeout": i32, "timed loop period": i64, "LTE Transport Sessions": "LTE Transport Session.gtype"[], "USRP session": "niUsrpRio Config v1 Host.lvlib__niUsrpRio Session.gtype", "FlexRIO session": T9, "UDP RX session": UdpNetworkConnectionRefnum, "UDP TX session": UdpNetworkConnectionRefnum, "sync found queue": Queue<bool>, "PDCCH CRC ok queue": Queue<bool>, "DL PDCCH status queue": Queue<cluster{"CRC ok": bool, "subframe number": u32}>, "DL PDSCH status queue": Queue<cluster{"CRC ok": bool, "subframe number": u32}>, "DL SINR queue": Queue<f64[]>, "PDSCH user data queue": Queue<u32>, "PDSCH user data UDP queue": Queue<T10>, "PDSCH user data throughput queue": Queue<T10>, "PUSCH user data queue": Queue<u32>, "PUSCH user data UDP queue": Queue<T10>, "PUSCH user data throughput queue": Queue<T10>, "UE feedback info FIFO": RTFifoRefnum<u8[]>, "Request information FIFO": RTFifoRefnum<"LTE Request Information.gtype">, "UDP TX outbound FIFO": RTFifoRefnum<u8[]>, "UDP RX inbound FIFO": RTFifoRefnum<u8[]>, "stop notifier": Notifier<string>, "DL RX scope": string, "UL RX scope": string, "external MAC log file": string, "external MAC process ID": u32}
  "LTE Confirmation States.gtype" = enum{"Success", "Unknown Message", "Message not Supported", "Unknown Parameter (Set)", "Missing Parameter (Set)", "Parameter (Set) Repetition", "Range Violation", "State Violation", "Timeout", "Config Payload Mismatch", "Length Mismatch", "Input Buffer Full", "Internal Error", "Instance ID Mismatch"}
  T11 = cluster{"Element 1": "LTE Confirmation States.gtype"[], "Value": u64[]}
diagram:
  sequence {
    frame 0 {
      # Set Controls to default values
      $"L1-L2 Interface active" <- FALSE
      $"eNB Transmitter" <- FALSE
      $"eNB Receiver" <- FALSE
      $"FPGA Ready" <- FALSE
      $"eNB RX Active" <- FALSE
      $"eNB TX Active" <- FALSE
      $"TX starting" <- FALSE
      $"eNB TX Power Spectrum" <- T1 {all zero or empty}
      $"eNB RX Power Spectrum" <- T1 {all zero or empty}
      $"eNB Coerced Gain [dB]" <- 0
      $"eNB Coerced Max RF TX Power [dBm]" <- 0
      $"PUSCH Throughput [Mbps]" <- 0
      $"Reported WB SINR" <- 0
      $"Average DL error rate" <- 0
      $"eNB Failure / Block Error Rate (BLER)" <- 0
      $"Reported DL Block Error Rate" <- 0
      $"Reported Subband SINR [dB]" <- f64[] []
      $"PUSCH Constellation" <- c128[] []
      $"Radio Frame Number" <- 0
      $"Reported DL ACK/NACK" <- enum{"NACK", "ACK", "DTX"}[] []
      $"Error Report" <- ""
      $Status <- ""
    }
  }
  call "RT Startup Create Notifier.gvi"(Error In=no error) -> (Error Out=w1)
  # NI API CHANGE
  s1 = w1  # shift register
  while {
    Wait Until Next Multiple(multiple to wait=100)
    call "RT Startup Receive Notivication.gvi"(error in=s1) -> (error out=w2, notification=w3)
    $Status <- w3
    Is Equal(x=w3, y="System Init Complete!") -> w4
    next s1 = w2
    stop if w4
  }
  call "LTE eNodeB Host Initialization.gvi"(USRP device=$"RIO Device", session in=$session, error in=w1, reference clock source=$"Reference Clock Source", start externally=$"Start Extern", external MAC=$"External MAC", command=$Command, arguments=$Arguments) -> (error out=w5, session=w6, device bandwidth=w7)
  sequence {
    frame 0 {
      $session <- w6
      call "Display Error.gvi"(type of dialog="continue or stop message", error in=w5)
      $"L1-L2 Interface active" <- TRUE
    }
  }
  disable {
    frame TARGET_TYPE == "RT", Default {
      # Transport layer moves packets from L1 to MAC Stub implementation or external MAC
      call "LTE Transport.gvi"(session=w6, error in=w5) -> (error out=w9)
      call "LTE Get Transport Session.gvi"(Session=w6, Transport Session Select="Transport PHY Timing to MAC") -> (LTE Transport Session=w10, Session dup=w11)
      Property Node(instance in=w10) -> ("transport out timing source name"=w12)
      w13 = 100  # priority in
      # NI API CHANGE
      call "RT Select CPU Core.gvi"(processor in=1, error in=w5) -> (processor out=w14, error out=w15)
      timed loop {
        Left Execution System Border Node(priority_in=w13, processor_in=w14)
        Left Timing Statistics Border Node() -> (wakeupreason_out=w16)
        call "LTE Get Transport Session.gvi"(Session=w11, Transport Session Select="Transport PHY Timing to MAC") -> (LTE Transport Session=w17, Session dup=w18)
        Left Timing Error Border Node(error_in=w15) -> (error_out=w19)
        call "LTE Transport Read From Transport.gvi"(API transport session=w17, error in=w19, allow read fail=$"L1-L2 Interface active") -> (transport out=w20, transport read success=w21, error out=w22)
        case (w21) {
          frame False {
            w23 = w22
          }
          frame True {
            call "LTE PHY Receive Timing Indication.gvi"(api transport in=w20, error in=w22) -> (SFN=w24, TTI index=w25, error out=w26)
            call "LTE Check Subframe for Transmit.gvi"(frame structure=$"eNB TX Frame Structure", subframe index=w25, UL TX=FALSE, error in=w26) -> (allow DL transmit=w27, error out=w28)
            case (w27) {
              frame False, Default {
                w23 = w28
              }
              frame True {
                w29 = 200  # maximal execution time MPU assembly
                Property Node(instance in=w18) -> ("UDP TX outbound FIFO"=w30, instance out=w31)
                case ($"Rate Adaption") {
                  frame False, Default {
                    w32 = $"eNB TX DCI"
                    w33 = w28
                    w34 = $"eNB TX UE Context"
                    w35 = $"eNB TX Frame Structure"
                    w36 = w24
                    w37 = w25
                  }
                  frame True {
                    call "LTE MCS Regulation.gvi"(SNR offset [dB]=$"SINR Offset [dB]", wideband SNR=$"Reported WB SINR", DCI in=$"eNB TX DCI", UE context=$"eNB TX UE Context") -> (DCI out=w32)
                    $"eNB TX DCI" <- w32
                    w33 = w28
                    w34 = $"eNB TX UE Context"
                    w35 = $"eNB TX Frame Structure"
                    w36 = w24
                    w37 = w25
                  }
                }
                call "LTE MAC Prepare Tx Config.gvi"(SFN=w36, TTI index=w37, eNB TX UE Context=w34, eNB TX DCI=w32, frame structure=w35, error in=w33) -> (MAC TX Config=w38, error out=w39)
                call "LTE MAC PDU Assembly.gvi"(MAC TX config in=w38, error in=w39, data FIFO in=w30, maximal execution time=w29) -> (MAC PDU Size=w40, MAC PDU=w41, error out=w42, IP Packets size exceeded=w43, MAC TX config out=w44)
                Feedback Node(input=w45) -> w46
                Add(w43, w46) -> w45
                $"IP Packets Size Exeeded Count" <- w45
                call "LTE PHY TX Request Confirm Abstraction.gvi"(MAC TX Config=w44, MAC PDU Size=w40, MAC PDU=w41, Device Location="eNB", error in=w42) -> (api transport out=w47, error out=w48, requests=w49)
                Property Node(instance in=w31) -> ("Request information FIFO"=w50, instance out=w51)
                call "LTE MAC Enque Requests.gvi"(RT FIFO reference=w50, requests=w49, error in=w48) -> (error out=w52)
                call "LTE Get Transport Session.gvi"(Session=w51, Transport Session Select="Transport MAC to PHY") -> (LTE Transport Session=w53)
                call "LTE Transport Send To Transport.gvi"(API transport session=w53, transport in=w47, error in=w52) -> (error out=w23)
              }
            }
          }
        }
        Right Timing Error Border Node(error_in=w23) -> (error_out=w54)
        Left Timing Source Border Node[AlarmName=L, DefaultTimingSourceName="1 MHz", DefaultTimingSourceType=2](mode_in="Process missed periods, ignore original phase", period_in=1, source_in=w12, structure_in="MAC Stub Tx")
        continue if $"L1-L2 Interface active"
      }
      call "LTE Remove Timed Loop Abort Error.gvi"(error in=w54, wake up reason=w16) -> (error out=w55)
      call "Stop On Error.gvi"(error in=w55, error source prefix="MAC Stub Tx") -> (error out=w56)
      call "LTE Get Transport Session.gvi"(Session=w6, Transport Session Select="Transport PHY to MAC") -> (LTE Transport Session=w57, Session dup=w58)
      w59 = 98  # priority in
      Property Node(instance in=w57) -> ("transport out timing source name"=w60)
      # NI API CHANGE
      call "RT Select CPU Core.gvi"(processor in=2, error in=w5) -> (processor out=w61, error out=w62)
      timed loop {
        Left Execution System Border Node(priority_in=w59, processor_in=w61)
        Left Timing Statistics Border Node() -> (wakeupreason_out=w63)
        call "LTE Get Transport Session.gvi"(Session=w58, Transport Session Select="Transport PHY to MAC") -> (LTE Transport Session=w64, Session dup=w65)
        Left Timing Error Border Node(error_in=w62) -> (error_out=w66)
        call "LTE Transport Read From Transport.gvi"(API transport session=w64, error in=w66, allow read fail=$"L1-L2 Interface active") -> (transport out=w67, transport read success=w68, error out=w69)
        case (w68) {
          frame False {
            w70 = w69
          }
          frame True {
            call "LTE Decode General Message Header.gvi"(message data in=w67, error in=w69) -> (decoded general message header=w71, error out=w72)
            Property Node(instance in=w71) -> ("message type ID"=w73)
            case (w73) {
              frame 0, Default {
                call "Build Error Cluster.gvi"(code=-1, description="MAC Stub Rx: unexpected API message", error in=w72) -> (error out=w70)
              }
              frame 16898 {
                # PHY_CNF
                Property Node(instance in=w65) -> ("Request information FIFO"=w74)
                Not(x=$"Stop on API Confirmation Errors") -> w75
                call "LTE Handle DL TX Confirm.gvi"(RT FIFO reference=w74, api transport in=w67, error in=w72, clear confirmation errors=w75) -> (error out=w70, confirm received counts=w76, confirmation evaluation error count=w77, negative confirm received count=w78)
                $"Received Confirmations" <- w76
                $Negatives <- w78
                $"Evaluation Errors" <- w77
              }
              frame 17409 {
                call "LTE PHY Receive RX Indication.gvi"(api transport in=w67, expected device location="eNB", error in=w72) -> (MAC RX Config=w79, MAC PDU=w80, error out=w81)
                # PHY_ULSCH_RX_IND
                Property Node(instance in=w79) -> ("CRC Result"=w82)
                Is Greater Than 0(x=w82) -> w83
                case (w83) {
                  frame False, Default {
                    w70 = w81
                  }
                  frame True {
                    call "LTE Extract Payload.gvi"(transport block=w80) -> (payload=w84)
                    Feedback Node(initial value=u8[] [], input=w85) -> w86
                    Build Array[ConcatenateInputs=True](w86, w84) -> w87
                    call "LTE Align Feedback Data.gvi"(data in=w87) -> (remaining portion=w85, feedback payload=w88)
                    Is Empty Array(array=w88) -> w89
                    Not(x=w89) -> w90
                    case (w90) {
                      frame False, Default {
                        w70 = w81
                      }
                      frame True {
                        call "LTE Interpret PUSCH Payload.gvi"(PUSCH payload=w88) -> (radioframe number=w91, ACK/NACK=w92, subband SNR=w93, wideband SNR=w94)
                        $"Radio Frame Number" <- w91
                        $"Reported DL ACK/NACK" <- w92
                        To Double Precision Float(number=w93) -> w95
                        $"Reported Subband SINR [dB]" <- w95
                        To Double Precision Float(number=w94) -> w96
                        $"Reported WB SINR" <- w96
                        call "LTE Calculate Average Error Rate.gvi"(ACK/NACK=w92) -> (error rate=w97)
                        $"Average DL error rate" <- w97
                        Tick Count() -> (timer value=w98)
                        Feedback Node(input=w99) -> w100
                        Is Greater Or Equal(x=w98, y=w100) -> w101
                        case (w101) {
                          frame False, Default {
                            w99 = w100
                          }
                          frame True {
                            $"Reported DL Block Error Rate" <- w97
                            Add(w98, 1000) -> w99
                          }
                        }
                        w70 = w81
                      }
                    }
                  }
                }
                $"UL RX Indication CRC OK" <- w83
              }
            }
          }
        }
        Right Timing Error Border Node(error_in=w70) -> (error_out=w102)
        Left Timing Source Border Node[AlarmName=L, DefaultTimingSourceName="1 MHz", DefaultTimingSourceType=2](mode_in="Process missed periods, ignore original phase", period_in=1, source_in=w60, structure_in="MAC Stub Rx")
        continue if $"L1-L2 Interface active"
      }
      call "LTE Remove Timed Loop Abort Error.gvi"(error in=w102, wake up reason=w63) -> (error out=w103)
      call "Stop On Error.gvi"(error in=w103, error source prefix="MAC Stub Rx") -> (error out=w104)
      Property Node(instance in=w6) -> ("timed loop period"=w105, instance out=w106)
      # NI API CHANGE
      call "RT Select CPU Core.gvi"(processor in=1, error in=w5) -> (processor out=w107, error out=w108)
      w109 = 100  # priority in
      timed loop {
        # receive PHY TTI timing indication (one per ms)
        Left Execution System Border Node(priority_in=w109, processor_in=w107)
        Left Timing Statistics Border Node()
        Left Timing Error Border Node(error_in=w108) -> (error_out=w110)
        call "LTE Receive Timing Indication RT.gvi"(session=w106, error in=w110, eNB TX Active=$"eNB TX Active") -> (error out=w111, subframe index=w112, subframe index valid=w113, DMA max elements remaining=w114, Num Tim Ind Missed=w115, DMA elements remaining=w116)
        $"Num Tim Ind Missed" <- w115
        case (w113) {
          frame False {
            w117 = w111
            w118 = w113
            w119 = w106
          }
          frame True, Default {
            call "Get Time.gvi"(error in_2=w111) -> (tick count (us)=w120, error out_2=w121)
            call "LTE TTI Counter to SFN and TTI.gvi"(TTI counter=w112, error in=w121) -> (SFN=w122, TTI=w123, error out=w124)
            call "Counter U16 Dominant Increment.gvi"() -> (count out=w125)
            call "LTE Encode PHY SAP Timing Indication.gvi"(reference ID=w125, SFN=w122, TTI index=w123, error in=w124) -> (encoded PHY SAP Timing Indication=w126, error out=w127)
            call "LTE Get Transport Session.gvi"(Session=w106, Transport Session Select="Transport PHY Timing to MAC") -> (LTE Transport Session=w128, Session dup=w119)
            call "LTE Transport Send To Transport.gvi"(API transport session=w128, transport in=w126, error in=w127) -> (error out=w117)
            $SFN <- w122
            $TTI <- w123
            $"PHY Timing Indication Received" <- w120
            w118 = w113
          }
        }
        Logical And(w118, $"eNB RX Active") -> w129
        case (w129) {
          frame False, Default {
            w130 = w117
          }
          frame True {
            call "LTE Send Dynamic UL Configuration.gvi"(UE context=$"eNB RX UE Context", DCI=$"eNB RX DCI", scope="RX", session=w119, error in=w117) -> (error out=w130)
          }
        }
        Right Timing Error Border Node(error_in=w130) -> (error_out=w131)
        $"Tim Ind in DMA" <- w116
        Left Timing Source Border Node[AlarmName=L, DefaultTimingSourceName="1 MHz", DefaultTimingSourceType=2](mode_in="Discard missed periods, ignore original phase", period_in=w105, structure_in="PHY SAP Tim")
        # NI API CHANGE
        $"Max Tim Ind in DMA" <- w114
        continue if $"L1-L2 Interface active"
      }
      call "Stop On Error.gvi"(error in=w131, error source prefix="PHY SAP Tim") -> (error out=w132)
      call "LTE Get Transport Session.gvi"(Session=w6, Transport Session Select="Transport MAC to PHY") -> (LTE Transport Session=w133, Session dup=w134)
      w135 = 99  # priority in
      call "RT Select CPU Core.gvi"(processor in=1, error in=w5) -> (processor out=w136, error out=w137)
      Property Node(instance in=w133) -> ("transport out timing source name"=w138)
      # NI API CHANGE
      timed loop {
        Left Execution System Border Node(priority_in=w135, processor_in=w136)
        # handover TX request to PHY FPGA
        Left Timing Statistics Border Node()
        call "LTE Get Transport Session.gvi"(Session=w134, Transport Session Select="Transport MAC to PHY") -> (LTE Transport Session=w139, Session dup=w140)
        Left Timing Error Border Node(error_in=w137) -> (error_out=w141)
        call "LTE Transport Read From Transport.gvi"(API transport session=w139, error in=w141, allow read fail=$"L1-L2 Interface active") -> (transport out=w142, transport read success=w143, error out=w144)
        call "Get Time.gvi"(error in=w144) -> (error out=w145, tick count (us)=w146)
        Subtract(x=w146, y=$"PHY Timing Indication Received") -> w147
        # reserve time buffer to transmit TX data to FPGA
        w148 = 700  # maximal allowed TX processing time [us]
        Is Greater(x=w147, y=w148) -> w149
        case (w143) {
          frame True {
            Property Node(instance in=$"eNB TX UE Context") -> ("Use UERS"=w152)
            call "LTE PHY TX Request Confirm Handler.gvi"(api transport in=w142, Expected SFN=$SFN, Expected TTI index=$TTI, Expected Device Location="eNB", error in=w145, frame structure=$"eNB TX Frame Structure", use UERS=w152, TX request too late=w149) -> (TX UE Context=w153, TX DCI=w154, TX Data=w155, error out=w156, api transport out=w157, output valid=w158)
            Logical And(w158, $"eNB TX Active") -> w151
            Property Node(instance in=w140) -> ("MAC Stub enabled"=w159, instance out=w160)
            case (w151) {
              frame False, Default {
                w161 = w156
                w162 = w160
              }
              frame True {
                call "LTE Send Dynamic DL TX Configuration.gvi"(DCI in=w154, UE context=w153, session=w160, error in=w156) -> (error out=w163, session dup=w164)
                call "LTE Send Dynamic DL Tx Payload.gvi"(session in=w164, TX data=w155, error in=w163) -> (error out=w161, session out=w162)
                case (w159) {
                  frame True { }
                  frame False {
                    # NI API CHANGE
                    $"eNB TX DCI" <- w154
                  }
                }
              }
            }
            Property Node(instance in=w162) -> ("Request information FIFO"=w165, "MAC Stub enabled"=w166)
            Array Size(array=w157) -> (size(s)=w167)
            Is Greater Than 0(x=w167) -> w168
            Logical And(not w166, $"Show Received Confirmations with external MAC enabled") -> w169
            case (w168) {
              frame False, Default {
                call "Build Error Cluster.gvi"(code=-1, description="Confirmation message response is empty.", error in=w161) -> (error out=w150)
              }
              frame True {
                call "LTE Get Transport Session.gvi"(Session=w162, Transport Session Select="Transport PHY to MAC") -> (LTE Transport Session=w170)
                call "LTE Transport Send To Transport.gvi"(API transport session=w170, transport in=w157, error in=w161) -> (error out=w150)
                case (w169) {
                  frame False { }
                  frame True {
                    # NI API CHANGE
                    call "LTE Handle DL TX Confirm.gvi"(RT FIFO reference=w165, api transport in=w157, clear confirmation errors=TRUE) -> (confirm received counts=w171, negative confirm received count=w172)
                    $"Received Confirmations" <- w171
                    $Negatives <- w172
                  }
                }
              }
            }
          }
          frame False {
            w150 = w145
            w151 = w143
          }
        }
        call "Get Time.gvi"(error in=w150) -> (error out=w173, tick count (us)=w174)
        Right Timing Error Border Node(error_in=w173) -> (error_out=w175)
        case (w151) {
          frame True {
            Subtract(x=w174, y=$"PHY Timing Indication Received") -> w176
            call "Get and Hold Maximum.gvi"(value=w176) -> (max value=w177)
            $"Max MAC TX Delay" <- w177
          }
          frame False { }
        }
        Left Timing Source Border Node[AlarmName=L, DefaultTimingSourceName="1 MHz", DefaultTimingSourceType=2](mode_in="Process missed periods, ignore original phase", period_in=1, source_in=w138, structure_in="PHY SAP Tx")
        continue if $"L1-L2 Interface active"
      }
      call "Stop On Error.gvi"(error in=w175, error source prefix="PHY SAP Tx") -> (error out=w178)
      # NI API CHANGE
      call "RT Select CPU Core.gvi"(processor in=2, error in=w5) -> (processor out=w179, error out=w180)
      w181 = 98  # priority in
      Property Node(instance in=w6) -> ("timed loop period"=w182, instance out=w183)
      timed loop {
        Left Execution System Border Node(priority_in=w181, processor_in=w179)
        Left Timing Statistics Border Node()
        Left Timing Error Border Node(error_in=w180) -> (error_out=w184)
        call "LTE Receice PUSCH Decoding Status.gvi"(session=w183, error in=w184) -> (PUSCH Decoding Status valid=w185, PUSCH Decoding Status=w186, error out=w187)
        case (w185) {
          frame False, Default {
            w188 = w187
          }
          frame True {
            Property Node(instance in=w183) -> ("PUSCH user data throughput queue"=w189, instance out=w190)
            call "LTE PDSCH Channel Decoder Status from U32.gvi"(bit vector in=w186, valid in=TRUE) -> (PDSCH decoder status=w191)
            Property Node(instance in=w191) -> ("user data"=w192, "transport block size"=w193, "CRC ok"=w194, instance out=w195)
            Enqueue Element(element=w195, error in=w187, queue=w189, timeout in ms=0) -> (error out=w196)
            call "LTE Receive PUSCH MAC PDU.gvi"(session=w190, transport block size=w193, error in=w196) -> (MAC PDU=w197, error out=w198)
            call "LTE Get Transport Session.gvi"(Session=w190, Transport Session Select="Transport PHY to MAC") -> (LTE Transport Session=w199)
            Boolean To Integer(Boolean=w194) -> (0, 1=w200)
            To Unsigned Byte Integer(number=w200) -> w201
            Array Size(array=w197) -> (size(s)=w202)
            To Unsigned Long Integer(number=w202) -> w203
            To Unsigned Byte Integer(number=w192) -> w204
            call "Counter U16 Dominant Increment.gvi"() -> (count out=w205)
            Property Node(instance in=$"eNB RX UE Context") -> ("RNTI"=w206)
            call "LTE Encode PHY SAP UL RX Indication.gvi"(reference ID=w205, SFN=0, TTI index=w204, MAC PDU=w197, MAC PDU Size=w203, RNTI=w206, CRC Result=w201) -> (encoded UL RX Indication=w207)
            call "LTE Transport Send To Transport.gvi"(API transport session=w199, transport in=w207, error in=w198) -> (error out=w188)
          }
        }
        Right Timing Error Border Node(error_in=w188) -> (error_out=w208)
        Left Timing Source Border Node[AlarmName=L, DefaultTimingSourceName="1 MHz", DefaultTimingSourceType=2](mode_in="Discard missed periods, ignore original phase", period_in=w182, structure_in="PHY SAP Rx")
        continue if $"L1-L2 Interface active"
      }
      call "Stop On Error.gvi"(error in=w208, error source prefix="PHY SAP Rx") -> (error out=w209)
      s2 = w5  # shift register
      while {
        Wait(time to wait=1)
        Property Node(instance in=$session) -> ("UDP TX outbound FIFO"=w210, "UDP TX session"=w211)
        s3 = s2  # shift register
        while {
          Udp Read I Pv 6 Binary(connection ID=w211, error in=s3, max size=10240, timeout ms=0) -> (data out=w214, error out=w215)
          call "Filter Error Codes.gvi"(codes to clear=[1, 113, 66, 56], error in=w215) -> (codes cleared=w216, error cleared?=w217, error out=w218)
          Search 1D Array(1D array=w216, element=113) -> (index of element=w219)
          Is Greater Or Equal To 0(x=w219) -> w220
          Search 1D Array(1D array=w216, element=56) -> (index of element=w221)
          Is Greater Or Equal To 0(x=w221) -> w222
          Not(x=w222) -> w223
          Is Empty Array(array=w214) -> w224
          Not(x=w224) -> w225
          Logical And(w223, w225) -> w226
          case (w217) {
            frame True {
              w227 = w218
            }
            frame False {
              RTFIFO Write(element=w214, error in=w218, overwrite on timeout=TRUE, rt fifo=w210, timeout in ms=0) -> (error out=w227)
            }
          }
          call "Is Error.gvi"(error in=w227) -> (is error?=w228)
          Logical Or(w228, w217, w224) -> w229
          append w220 to w212
          append w226 to w213
          next s3 = w227
          stop if w229
        }
        Or Array Elements(Boolean array=w212) -> (logical OR=w230)
        $"Packet Loss In" <- w230
        Or Array Elements(Boolean array=w213) -> (logical OR=w231)
        $"Data Transfer In" <- w231
        call "Check Stop.gvi"(error in=s3) -> (error out=w232, stop=w233)
        next s2 = w232
        stop if w233
      }
      call "Stop On Error.gvi"(error in=s2) -> (error out=w234)
      Build Array[ConcatenateInputs=True](w56, w104, w9, w132, w178, w209, w234) -> w8
    }
    frame TARGET_TYPE != "RT" {
      s4 = w5  # shift register
      s5 = 0  # shift register
      while {
        Wait Until Next Multiple(multiple to wait=100)
        call "LTE Read UL Data.gvi"(session=$session, error in=s4) -> (error out=w235, radioframe number=w236, output valid=w237, DL ACK/NACK=w238, subband SNR=w239, wideband SNR=w240)
        # read and decode PUSCH feedback information
        # use feedback information to apply correct MCS
        # 5
        case (w237) {
          frame False, Default {
            w241 = s5
            w242 = w235
          }
          frame True {
            $"Radio Frame Number" <- w236
            $"Reported DL ACK/NACK" <- w238
            To Double Precision Float(number=w239) -> w243
            $"Reported Subband SINR [dB]" <- w243
            To Double Precision Float(number=w240) -> w244
            $"Reported WB SINR" <- w244
            call "LTE Calculate Average Error Rate.gvi"(ACK/NACK=w238) -> (error rate=w245)
            $"Average DL error rate" <- w245
            Increment(x=s5) -> w241
            Quotient And Remainder(x=w241, y=10) -> (x-y*floor(x/y)=w246)
            Is Equal To 0(x=w246) -> w247
            case (w247) {
              frame False, Default { }
              frame True {
                $"Reported DL Block Error Rate" <- w245
              }
            }
            w242 = w235
          }
        }
        call "Check Stop.gvi"(error in=w242) -> (error out=w248, stop=w249)
        next s4 = w248
        next s5 = w241
        stop if w249
      }
      call "Stop On Error.gvi"(error in=s4) -> (error out=w250)
      s6 = w5  # shift register
      while {
        # use SINR information to apply correct MCS
        case ($"eNB TX Active") {
          frame False, Default {
            Wait(time to wait=10)
            w251 = s6
            w252 = TRUE
          }
          frame True {
            call "LTE Receive Timing Indication.gvi"(session=$session, error in=s6) -> (session dup=w253, error out=w254, new timing indication=w252)
            case (w252) {
              frame False, Default {
                w251 = w254
              }
              frame True {
                case ($"Rate Adaption") {
                  frame False, Default {
                    w255 = $"eNB TX DCI"
                    w256 = w254
                  }
                  frame True {
                    call "LTE MCS Regulation.gvi"(SNR offset [dB]=$"SINR Offset [dB]", wideband SNR=$"Reported WB SINR", DCI in=$"eNB TX DCI", UE context=$"eNB TX UE Context") -> (DCI out=w255)
                    w256 = w254
                  }
                }
                call "LTE Send Dynamic DL TX Configuration.gvi"(DCI in=w255, UE context=$"eNB TX UE Context", session=w253, error in=w256) -> (error out=w251, coerced DCI=w257, DCI modified=w258)
                case (w258) {
                  frame False, Default { }
                  frame True {
                    $"eNB TX DCI" <- w257
                  }
                }
              }
            }
          }
        }
        Logical And(w252, $"eNB RX Active") -> w259
        # 5
        case (w259) {
          frame False, Default {
            w260 = w251
          }
          frame True {
            call "LTE Send Dynamic UL Configuration.gvi"(UE context=$"eNB RX UE Context", DCI=$"eNB RX DCI", scope="RX", session=$session, error in=w251) -> (error out=w260)
          }
        }
        call "Check Stop.gvi"(error in=w260) -> (error out=w261, stop=w262)
        next s6 = w261
        stop if w262
      }
      call "Stop On Error.gvi"(error in=s6) -> (error out=w263)
      s7 = w5  # shift register
      s8 = 0  # shift register
      while {
        # receive UDP data from network and send it to the FPGA as PDSCH payload data of the transmitter
        # read received PDSCH payload data from FPGA and send it to the specified UDP port
        Wait Until Next Multiple(multiple to wait=0)
        call "LTE Receive UDP Data.gvi"(session=$session, eNB TX active=$"eNB TX Active", UDP packet counter in=s8, error in=s7) -> (FIFO full=w264, data transfer=w265, UDP packet counter out=w266, error out=w267)
        $"Packet Loss In" <- w264
        $"Data Transfer In" <- w265
        # 6
        call "Check Stop.gvi"(error in=w267) -> (error out=w268, stop=w269)
        next s7 = w268
        next s8 = w266
        stop if w269
      }
      call "Stop On Error.gvi"(error in=s7) -> (error out=w270)
      Build Array(w250, w263, w270) -> w8
    }
  }
  s9 = w5  # shift register
  while {
    Wait Until Next Multiple(multiple to wait=100)
    Feedback Node[DelayCount=3](input=w271) -> w272
    call "LTE Determine Configuration Trigger.gvi"(RX enabled=$"eNB Receiver", TX enabled=$"eNB Transmitter") -> (trigger RX configuration=w273, trigger TX configuration=w274)
    # configure eNB RX/TX baseband and RF when enabled
    case (w273) {
      frame False, Default {
        w275 = s9
      }
      frame True {
        case ($"eNB Receiver") {
          frame False, Default {
            call "LTE Disable UL RX.gvi"(session=$session, error in=s9) -> (error out=w275)
            sequence {
              frame 0 {
                $"eNB RX Active" <- FALSE
              }
            }
          }
          frame True {
            Property Node(instance in=$session) -> ("real time mode"=w276)
            call "LTE Setup UL RX Baseband.gvi"(frame structure=$"eNB RX Frame Structure", session in=$session, error in=s9, cell ID=$"eNB RX Cell ID", RF timing offset=$"eNB Timing Offset", UE Context=$"eNB RX UE Context", DCI=$"eNB RX DCI", real time mode=w276) -> (error out=w277, session dup=w278)
            call "LTE Setup RX.gvi"(session in=w278, RX port=$"eNB RX RF Port (USRP)", error in=w277, RX frequency [Hz]=$"eNB RX Frequency [Hz]", gain value [dB]=$"eNB Coerced Gain [dB]", LTE scope="UL") -> (session out=w279, coerced gain [dB]=w280, error out=w281, coerced frequency [Hz]=w282)
            $session <- w279
            $"eNB Coerced Gain [dB]" <- w280
            $"eNB RX Frequency [Hz]" <- w282
            case (w281) {
              frame Error {
                $"eNB Receiver" <- FALSE
                w275 = w281
              }
              frame No Error {
                $"eNB RX Active" <- TRUE
                w275 = w281
              }
            }
          }
        }
      }
    }
    # 1
    case (w274) {
      frame False, Default {
        w283 = s9
      }
      frame True {
        case ($"eNB Transmitter") {
          frame False, Default {
            sequence {
              frame 0 {
                $"eNB TX Active" <- FALSE
              }
              frame 1 {
                Wait(time to wait=10)
              }
            }
            call "LTE Disable DL TX.gvi"(session=$session, error in=s9) -> (error out=w283)
          }
          frame True {
            case (s9) {
              frame Error {
                w284 = s9
              }
              frame No Error {
                $"TX starting" <- TRUE
                w284 = s9
              }
            }
            Property Node(instance in=$session) -> ("real time mode"=w285)
            call "LTE Setup DL TX Baseband.gvi"(session in=$session, UDP receive port=$"UDP Receive Port", frame structure=$"eNB TX Frame Structure", cell ID=$"eNB TX Cell ID", UE context=$"eNB TX UE Context", error in=w284, DCI=$"eNB TX DCI", real time mode=w285) -> (session out=w286, error out=w287)
            call "LTE Setup TX.gvi"(session in=w286, TX frequency [Hz]=$"eNB TX Frequency [Hz]", TX power level [dB]=$"eNB Max RF TX Power [dBm]", TX port=$"eNB TX RF Port (USRP)", error in=w287, LTE scope="DL", timing advance=0) -> (coerced output power [dB]=w288, error out=w289, session dup=w290, coerced frequency [Hz]=w291, coerced power level setting [dB]=w292)
            $session <- w290
            $"eNB Coerced Max RF TX Power [dBm]" <- w288
            case (w289) {
              frame No Error, Default {
                $"eNB TX Active" <- TRUE
                $"TX starting" <- FALSE
                call "LTE Setup DL TX Set Active.gvi"(session in=w290, error in=w289) -> (error out=w283)
              }
              frame Error {
                $"eNB Transmitter" <- FALSE
                $"TX starting" <- FALSE
                call "LTE Check UDP Port In Use.gvi"(error in=w289) -> (error out=w283)
              }
            }
            $"eNB TX Frequency [Hz]" <- w291
            $"eNB Max RF TX Power [dBm]" <- w292
          }
        }
      }
    }
    Merge Errors(w275, w283) -> (error out=w293)
    # synchronize the exit condition across all loops of the host application
    call "Create Stop.gvi"(error in=w293, stop in=$stop) -> (error out=w294)
    call "Check Stop.gvi"(error in=w294) -> (error out=w295, stop=w271)
    # Disable TX and RX to
    # ensure proper shutdown
    Not(x=w271) -> w296
    $"L1-L2 Interface active" <- w296
    case (w271) {
      frame False, Default { }
      frame True {
        $"eNB Receiver" <- FALSE
        $"eNB Transmitter" <- FALSE
      }
    }
    case (s9) {
      frame Error { }
      frame No Error {
        $"FPGA Ready" <- TRUE
      }
    }
    next s9 = w295
    stop if w272
  }
  call "Stop On Error.gvi"(error in=s9) -> (error out=w297)
  s10 = w5  # shift register
  while (iteration -> i1) {
    Wait Until Next Multiple(multiple to wait=50)
    disable {
      frame TARGET_TYPE == "RT", Default {
        w298 = $session
        w299 = s10
      }
      frame TARGET_TYPE != "RT" {
        call "LTE Read PUSCH Decoder Status.gvi"(session in=$session, error in=s10) -> (error out=w299, session dup=w298)
      }
    }
    call "LTE Get ADC and IFFT Status.gvi"(session in=w298, error in=w299) -> (ADC values clipped=w300, error out=w301, TX IFFT output clipped=w302, RX DDC values clipped=w303, session dup=w304)
    call "LTE Read UL BB Power.gvi"(error in=w301, session in=w304) -> (session dup=w305, error out=w306, RX baseband input power=w307)
    call "LTE Read TX BB Power.gvi"(error in=w306, session in=w305, TX reference level [dBm]=$"eNB Coerced Max RF TX Power [dBm]", LTE scope="DL") -> (session dup=w308, error out=w309, TX power [dBm]=w310, TX baseband power [dBFS]=w311)
    call "LTE Calculate Power Calibration Offset.gvi"(session in=w308, frequency [Hz]=$"eNB RX Frequency [Hz]", error in=w309, LTE scope="UL") -> (session dup=w312, power calibration offset [dB]=w313, error out=w314)
    $"power calibration offset [dB]" <- w313
    Not(x=$"eNB AGC") -> w315
    call "LTE Control Power Gain.gvi"(expected signal range lower bound=-17, use manual gain=w315, BB input power=w307, gain in=$"eNB Coerced Gain [dB]", manual gain value [dB]=$"eNB Manual Gain [dB]", expected signal range upper bound=-15, power calibration offset [dB]=w313) -> (RF input power [dBm]=w316, power [dBFS]=w317, gain out=w318)
    # read sync status and baseband power levels from FPGA and feed them into automatic gain control (AGC)
    # use manual gain value if AGC is disabled
    # configure frequency offset on FPGA
    # read PUSCH decoder status
    Logical And(not $"TX starting", $"eNB Receiver", $"eNB RX Active") -> w319
    # 2
    case (w319) {
      frame False, Default {
        w320 = w314
      }
      frame True {
        call "LTE Apply AGC Output.gvi"(session=w312, LTE scope="UL", error in=w314, apply values=w319, AGC output=w318) -> (coerced gain [dB]=w321, error out=w320)
        $"eNB Coerced Gain [dB]" <- w321
      }
    }
    call "Check Stop.gvi"(error in=w320) -> (error out=w322, stop=w323)
    $"eNB RF TX Power [dBm]" <- w310
    $"eNB Baseband TX Power [dBFS]" <- w311
    $"eNB Baseband RX Power [dBFS]" <- w317
    $"eNB RF RX Power [dBm]" <- w316
    $"eNB Applied Gain [dB]" <- $"eNB Coerced Gain [dB]"
    $"eNB ADC Values Clipped" <- w300
    $"eNB TX IFFT Output Clipped" <- w302
    To Unsigned Long Integer(number=i1) -> w324
    Quotient And Remainder(x=w324, y=10) -> (x-y*floor(x/y)=w325)
    Is Equal To 0(x=w325) -> w326
    Logical Or(w303, w326) -> w327
    Feedback Node(enable?=w327, input=w303) -> w328
    Feedback Node(enable?=w326, input=w328) -> w329
    $"eNB DDC Values Clipped" <- w329
    next s10 = w322
    stop if w323
  }
  call "Stop On Error.gvi"(error in=s10) -> (error out=w330)
  s11 = w5  # shift register
  while (iteration -> i2) {
    Wait Until Next Multiple(multiple to wait=20)
    # NI API CHANGE
    Quotient And Remainder(x=i2, y=5) -> (x-y*floor(x/y)=w331)
    Select(s=$"External MAC", t=3, f=w331) -> w332
    # read RX/TX baseband data values and PDCCH/PDSCH constellation data from FPGA and draw corresponding diagrams
    # 3
    case (w332) {
      frame 0, Default {
        call "LTE Read TX Data.gvi"(session=$session, error in=s11) -> (error out=w334, TX baseband data=w335)
        call "LTE Calculate TX Power Spectrum.gvi"(TX data=w335, error in=w334, coerced gain [dB]=$"eNB Coerced Max RF TX Power [dBm]") -> (TX power spectrum=w336, error out=w333)
        $"eNB TX Power Spectrum" <- w336
      }
      frame 1 {
        call "LTE Read RX Data.gvi"(session=$session, error in=s11) -> (RX data=w337, error out=w338)
        call "LTE Calculate RX Power Spectrum.gvi"(RX data=w337, coerced gain [dB]=$"eNB Coerced Gain [dB]", error in=w338, power calibration offset [dB]=$"power calibration offset [dB]") -> (RX power spectrum=w339, error out=w333)
        $"eNB RX Power Spectrum" <- w339
      }
      frame 2 {
        call "LTE Read Constellation Data.gvi"(session=$session, error in=s11, symbol number for display=$"symbol number for PUSCH constellation", RX tab=-1) -> (constellation data=w340, display data out=w341, error out=w333)
        case (w341) {
          frame False, Default { }
          frame True {
            $"PUSCH Constellation" <- w340
          }
        }
      }
      frame 3 {
        case ($"External MAC") {
          frame False, Default {
            w333 = s11
          }
          frame True {
            call "LTE Read External MAC Output.gvi"(session=$session, error in=s11, full log=FALSE) -> (external MAC log output=w342, error out=w333)
            $"External MAC Output" <- w342
          }
        }
      }
      frame 4 {
        w333 = s11
      }
    }
    call "Check Stop.gvi"(error in=w333) -> (error out=w343, stop=w344)
    next s11 = w343
    stop if w344
  }
  sequence {
    frame 0 {
      # NI API CHANGE
      call "LTE Read External MAC Output.gvi"(session=$session, error in=s11, full log=TRUE) -> (external MAC log output=w345, error out=w346)
      $"External MAC Output" <- w345
    }
  }
  call "Stop On Error.gvi"(error in=w346) -> (error out=w347)
  s12 = 0  # shift register
  s13 = w5  # shift register
  while {
    Wait Until Next Multiple(multiple to wait=1000)
    # compute throughput and block error rate and draw corresponding diagrams
    Tick Count() -> (timer value=w348)
    Subtract(x=w348, y=s12) -> w349
    call "LTE Calculate UL Throughput and BLER.gvi"(time difference=w349, session=$session, error in=s13) -> (UL throughput (current)=w350, error out=w351, UL BLER=w352)
    # 4
    case ($"eNB RX Active") {
      frame False, Default { }
      frame True {
        $"PUSCH Throughput [Mbps]" <- w350
        $"eNB Failure / Block Error Rate (BLER)" <- w352
        $"PUSCH BLER (current)" <- w352
      }
    }
    call "Check Stop.gvi"(error in=w351) -> (error out=w353, stop=w354)
    next s12 = w348
    next s13 = w353
    stop if w354
  }
  call "Stop On Error.gvi"(error in=s13) -> (error out=w355)
  Build Array[ConcatenateInputs=True](w297, w330, w347, w355, w8) -> w356
  sequence (after w356) {
    frame 0 {
      # NI API CHANGE
      call "RT Startup Send Notification.gvi"(Error In=s1, Notification="System Stopped!") -> (Error Out=w357)
      call "RT Startup Destroy Notifier.gvi"(error in=w357)
    }
  }
  # NI API CHANGE
  call "LTE Read External MAC Output.gvi"(session=w6, full log=TRUE) -> (external MAC log output=w358)
  $"External MAC Output" <- w358
  sequence {
    frame 0 {
      call "LTE eNodeB Host Cleanup.gvi"(session=$session, error in=no error) -> (error out=w359)
      Build Array[ConcatenateInputs=True](w356, w359) -> w360
      $"FPGA Ready" <- FALSE
    }
  }
  call "LTE Generate Error Report.gvi"(error in=w360) -> (error report=w361, error occured=w362)
  $"Error Report" <- w361
  case (w362) {
    frame False, Default { }
    frame True {
      # Switch to status tab
      # in case of error
      $Tab <- 2
    }
  }
  $"device bandwidth [MHz]" <- w7
